# Grasshopper definition BoidSystem (Rock-Paper-Scissors).gh (Grasshopper 1.0.7)
# plug-ins: ABxM.Grasshopper, Human

# ----
# © 2023 by ICD University of Stuttgart
panel = Panel("0 to 50")
rectangle = Rectangle(Plane=PlaneXY(0, 0, 0), XSize=panel, YSize="0 to 50", Radius=0)  # -> Rectangle, Length
rec = Rectangle(rectangle.Rectangle)
pop2d = Populate2D(Region=rec, Count=100, Seed=1)

offset = OffsetCurve(Curve=rec, Distance=1, Corners=1)
preview = CustomPreview(Geometry=offset, Material=ColourSwatch(SwatchColor=RGB(207, 207, 207)))

# ---- group: Separation
# Behaviours
containment = CSharpScript(
    D="4",
    W=Slider(1, range=0..1),
    Reference="C:\Users\ainho\AppData\Roaming\McNeel\Rhinoceros\packages\7.0\ABxM-Core\1.5.4\ABxM.Core.dll")  # -> out, oBehavior; inputs D: Double, W: Double
# ---------- containment: C# usings ----------
using ABxM.Core;
using ABxM.Core.Agent;
using ABxM.Core.AgentSystem;
using ABxM.Core.Behavior;
using ABxM.Core.Environments;
# ---------- containment: C# ----------
    behavior.Distance = D;
    behavior.Weight = W;
    oBehavior = behavior;
# ---------- containment: C# additional code ----------
  SeparationBehavior behavior = new SeparationBehavior(1.0);

  public class SeparationBehavior : BehaviorBase
  {

    public double Distance = 1.0;
    public double Power = 1.0;

    public SeparationBehavior(double weight)
    {
      Weight = weight;
    }

    public override void Execute(AgentBase agent)
    {
      Boid boid = agent as Boid;
      String boidType = boid.CustomData["Type"] as string;

      BoidSystem boidSystem = (BoidSystem) boid.AgentSystem;

      List<Boid> neighbors = boidSystem.FindNeighbors(boid, Distance);

      if (neighbors.Count == 0) return;

      //======================================================================================================
      // Task: Compute the "force" vector caused by this behavior and add it to the list "locoAgent.Force"
      //======================================================================================================

      Vector3d separation = Vector3d.Zero;

      foreach (Boid neighbor in neighbors)
      {
        if (neighbor.CustomData["Type"] as string == boidType)
        {
          Vector3d moveAway = boid.Position - neighbor.Position;
          double len = moveAway.Length;

          if (moveAway.IsZero) moveAway = Vector3d.XAxis;

          Vector3d thisMove = Vector3d.Zero;
          if (len < Distance)
          {
            moveAway.Unitize();
            thisMove = moveAway * Math.Pow((Distance - len) / Distance, Power) * Distance;
          }
          separation += thisMove;
        }
      }

      boid.AddForce(separation * Weight);
    }
  }
# ---------- end containment ----------

# ---- group: Cohesion
panel_2 = Panel("6")
containment_2 = CSharpScript(
    D=panel_2,
    W=Slider(0.2, range=0..1),
    Reference="C:\Users\ainho\AppData\Roaming\McNeel\Rhinoceros\packages\7.0\ABxM-Core\1.5.4\ABxM.Core.dll")  # -> out, oBehavior; inputs D: Double, W: Double
# ---------- containment_2: C# ----------
    behavior.Distance = D;
    behavior.Weight = W;
    oBehavior = behavior;
# ---------- containment_2: C# additional code ----------
  CohesionBehavior behavior = new CohesionBehavior(1.0);

  public class CohesionBehavior : BehaviorBase
  {

    public double Distance = 1.0;

    public CohesionBehavior(double weight)
    {
      Weight = weight;
    }

    public override void Execute(AgentBase agent)
    {
      Boid boid = agent as Boid;
      String boidType = boid.CustomData["Type"] as string;

      BoidSystem boidSystem = (BoidSystem) boid.AgentSystem;

      List<Boid> neighbors = boidSystem.FindNeighbors(boid, Distance);

      if (neighbors.Count == 0) return;

      //======================================================================================================
      // Task: Compute the "force" vector caused by this behavior and add it to the list "locoAgent.Force"
      //======================================================================================================

      // get average of neighbour positions
      Point3d center = Point3d.Origin;
      int count = 0;
      foreach (Boid neighbor in neighbors)
      {
        string neighborValue = neighbor.CustomData["Type"] as string;
        if (neighborValue == boidType)
        {
          center += neighbor.Position;
          count++;
        }
      }

      if(count > 0)
        center /= count;

      if (center == Point3d.Origin)
        return;

      // move to average of neighbour positions
      Vector3d moveToCenter = center - boid.Position;
      //Vector steer = boid.Velocity - moveToCenter;
      //moveToCenter.Unitize();
      boid.AddForce(Weight * moveToCenter);

      //boid.AddForce(Weight * steer);

    }

    public Vector3d LimitVectorLength(Vector3d v, double maxLength)
    {
      if (v.Length < maxLength) return v;
      else return v * maxLength / v.Length;
    }
  }
# ---------- end containment_2 ----------

# ---- group: Alignment
containment_3 = CSharpScript(
    D=panel_2,
    W=Slider(0.8, range=0..1),
    Reference="C:\Users\ainho\AppData\Roaming\McNeel\Rhinoceros\packages\7.0\ABxM-Core\1.5.4\ABxM.Core.dll")  # -> out, oBehavior; inputs D: Double, W: Double
# ---------- containment_3: C# ----------
    behavior.Distance = D;
    behavior.Weight = W;
    oBehavior = behavior;
# ---------- containment_3: C# additional code ----------
  AlignmentBehavior behavior = new AlignmentBehavior(1.0);

  public class AlignmentBehavior : BehaviorBase
  {

    public double Distance = 1.0;
    public double Power = 1.0;

    public AlignmentBehavior(double weight)
    {
      Weight = weight;
    }

    public override void Execute(AgentBase agent)
    {
      Boid boid = agent as Boid;
      String boidType = boid.CustomData["Type"] as string;

      BoidSystem boidSystem = (BoidSystem) boid.AgentSystem;

      List<Boid> neighbors = boidSystem.FindNeighbors(boid, Distance);

      if (neighbors.Count == 0) return;

      //======================================================================================================
      // Task: Compute the "force" vector caused by this behavior and add it to the list "locoAgent.Force"
      //======================================================================================================

      Vector3d neighborVelocities = Vector3d.Zero;
      int count = 0;
      foreach (Boid neighbor in neighbors)
      {
        string neighborValue = neighbor.CustomData["Type"] as string;
        if (neighborValue == boidType)
        {
          neighborVelocities += neighbor.Velocity;
          count++;
        }
      }

      if(count > 0)
        neighborVelocities /= count;

      // according to Reynolds and Shiffmann
      neighborVelocities.Unitize();
      neighborVelocities *= boidSystem.MaxSpeed;
      Vector3d steer = neighborVelocities - boid.Velocity;

      // freestyle
      //Vector3d steer = neighborVelocities; // - locoAgent.Velocity;

      steer = LimitVectorLength(steer, boidSystem.MaxForce);

      boid.AddForce(Weight * steer);

    }

    public Vector3d LimitVectorLength(Vector3d v, double maxLength)
    {
      if (v.Length < maxLength) return v;
      else return v * maxLength / v.Length;
    }
  }
# ---------- end containment_3 ----------

# ---- group: Rock-Paper-Scissors
containment_4 = CSharpScript(
    D="3",
    W=Slider(0.2, range=0..1),
    Reference="C:\Users\ainho\AppData\Roaming\McNeel\Rhinoceros\packages\7.0\ABxM-Core\1.5.4\ABxM.Core.dll")  # -> out, oBehavior; inputs D: Double, W: Double
# ---------- containment_4: C# ----------
    behavior.Distance = D;
    behavior.Weight = W;
    oBehavior = behavior;
# ---------- containment_4: C# additional code ----------
  RPSBehavior behavior = new RPSBehavior(1.0);

  public class RPSBehavior : BehaviorBase
  {

    public double Distance = 1.0;

    public RPSBehavior(double weight)
    {
      Weight = weight;
    }

    public override void Execute(AgentBase agent)
    {
      Boid boid = agent as Boid;
      String boidType = (string) boid.CustomData["Type"];

      // boid.NewCustomData = new Dictionary<string, object>(boid.CustomData); // this is to make sure that in case we exit
      // out of the behavior NewCustomData is not empty
      // boid.NewCustomData.Add("Type", boidType);

      BoidSystem boidSystem = (BoidSystem) boid.AgentSystem;

      List<Boid> neighbors = boidSystem.FindNeighbors(boid, Distance);

      if (neighbors.Count == 0) return;

      //======================================================================================================
      // Task: Compute the "force" vector caused by this behavior and add it to the list "locoAgent.Force"
      //======================================================================================================

      string newType = boidType;

      int closestIndex = 0;
      Double clostestDistance = boid.Position.DistanceToSquared(neighbors[closestIndex].Position);

      for (int i = 1; i < neighbors.Count; i++)
      {
        double currentDistance = boid.Position.DistanceToSquared(neighbors[i].Position);
        if (currentDistance < clostestDistance)
        {
          closestIndex = i;
          clostestDistance = currentDistance;
        }
      }

      if (boidType == "R" && (string) neighbors[closestIndex].CustomData["Type"] == "P")
        newType = "P";
      if (boidType == "P" && (string) neighbors[closestIndex].CustomData["Type"] == "S")
        newType = "S";
      if (boidType == "S" && (string) neighbors[closestIndex].CustomData["Type"] == "R")
        newType = "R";

      //boid.CustomData["Type"] = newType;
      boid.NewCustomData["Type"] = newType;
    }
  }
# ---------- end containment_4 ----------

# ---- group: Alternative Containment Behaviour
containment_5 = CSharpScript(
    R=rec,
    W=Slider(1, range=0..10),
    Reference="C:\Users\ainho\AppData\Roaming\McNeel\Rhinoceros\packages\7.0\ABxM-Core\1.5.4\ABxM.Core.dll")  # -> out, oBehavior; inputs R: Rectangle3d, W: Double
# ---------- containment_5: C# ----------
    behavior.Weight = W;
    behavior.Rectangle = R;
    oBehavior = behavior;
# ---------- containment_5: C# additional code ----------
  RectangleContainmentBehaviour behavior = new RectangleContainmentBehaviour(1.0);

  public class RectangleContainmentBehaviour : BehaviorBase
  {

    public Rectangle3d Rectangle = Rectangle3d.Unset;

    public RectangleContainmentBehaviour(double weight)
    {
      Weight = weight;
      //iBox = B;
    }

    public override void Execute(AgentBase agent)
    {
      Boid boid = agent as Boid;

      //======================================================================================================
      // Task: Compute the "force" vector caused by this behavior and add it to the list "locoAgent.Force"
      //======================================================================================================

      Vector3d desired = boid.Velocity;
      Vector3d steering = Vector3d.Unset;

      /*
      We shouldn't touch location and velocity directly, but there are some exceptions (Shiffman 2012).
      Here we are applying a hard constraint on the position of the agent as it tries to exceed the world.
      */

      if (Rectangle.IsValid){
        if (boid.Position.X < Rectangle.BoundingBox.Min.X){
          desired.X *= -1;
          boid.Position.X = Rectangle.BoundingBox.Min.X;
        } else if (boid.Position.X > Rectangle.BoundingBox.Max.X){
          desired.X *= -1;
          boid.Position.X = Rectangle.BoundingBox.Max.X;
        }
        if (boid.Position.Y < Rectangle.BoundingBox.Min.Y){
          desired.Y *= -1;
          boid.Position.Y = Rectangle.BoundingBox.Min.Y;
        } else if (boid.Position.Y > Rectangle.BoundingBox.Max.Y){
          desired.Y *= -1;
          boid.Position.Y = Rectangle.BoundingBox.Max.Y;
        }
        steering = desired - boid.Velocity;
        boid.AddForce(steering * Weight);
      }
    }
  }
# ---------- end containment_5 ----------

# ---- group: Drag
containment_6 = CSharpScript(
    W=Slider(0.05, range=0..1),
    Reference="C:\Users\ainho\AppData\Roaming\McNeel\Rhinoceros\packages\7.0\ABxM-Core\1.5.4\ABxM.Core.dll")  # -> out, oBehavior; inputs W: Double
# ---------- containment_6: C# ----------
    behavior.Drag = W;
    oBehavior = behavior;
# ---------- containment_6: C# additional code ----------
  DragBehaviour behavior = new DragBehaviour(1.0);

  public class DragBehaviour : BehaviorBase
  {

    public double Drag = 0.0;

    public DragBehaviour(double drag)
    {
      Drag = drag;
    }

    public override void Execute(AgentBase agent)
    {
      Boid boid = agent as Boid;

      //======================================================================================================
      // Task: Compute the "force" vector caused by this behavior and add it to the list "locoAgent.Force"
      //======================================================================================================

      boid.Velocity *= 1.0 - this.Drag;
    }
  }
# ---------- end containment_6 ----------

# ---- group: Cancellation Behavior (for when there is a clear winner) + Preview needs to be on
pt = Point(Point(-0.2415397837, -4.604489546, 0))
containment_7 = CSharpScript(iTextPlane=pt, Reference="C:\Users\ainho\AppData\Roaming\McNeel\Rhinoceros\packages\7.0\ABxM-Core\1.5.4\ABxM.Core.dll")  # -> out, oBehavior; inputs iTextPlane: Plane
# ---------- containment_7: C# usings ----------
using ABxM.Core;
using ABxM.Core.Agent;
using ABxM.Core.AgentSystem;
using ABxM.Core.Behavior;
using ABxM.Core.Environments;

using System.Linq;
# ---------- containment_7: C# ----------
    textPlane = iTextPlane;
    oBehavior = behavior;
# ---------- containment_7: C# additional code ----------
  CancelMe behavior = new CancelMe();
  public static string winner = "";
  public static Plane textPlane = Plane.WorldXY;

  public override void DrawViewportWires(IGH_PreviewArgs args)
  {
    if (!string.IsNullOrEmpty(winner))
    {
      args.Display.Draw2dText(winner, System.Drawing.Color.Black, textPlane.Origin, false, 50);
    }
  }

  public class CancelMe : BehaviorBase
  {
    public CancelMe()
    {
    }

    public override void Execute(AgentBase agent)
    {
      Boid boid = agent as Boid;
      String boidType = (string) boid.CustomData["Type"];

      BoidSystem boidSystem = (BoidSystem) boid.AgentSystem;

      List<string> types = boidSystem.Agents.Select(ag => ag.CustomData["Type"] as string).ToList();

      HashSet<string> uniqueTypes = new HashSet<string>(types); // Automatically creates a unique list

      if(uniqueTypes.Count == 2)
      {
        if(!this.Solver.IsCancelled)
        {
          if(uniqueTypes.Contains("P") && uniqueTypes.Contains("R")) winner = "Paper";
          if(uniqueTypes.Contains("P") && uniqueTypes.Contains("S")) winner = "Scissors";
          if(uniqueTypes.Contains("R") && uniqueTypes.Contains("S")) winner = "Rock";
          winner += " wins!";
        }
        this.Solver.CancelExecution();
      }
      else
      {
        winner = "";
        if(agent.Id == boidSystem.Agents.Count - 1)
        {
          Dictionary<string, int> stringCounts = new Dictionary<string, int>();
          foreach (string item in types)
          {
            // If the string is already in the dictionary, increment its count
            if (stringCounts.ContainsKey(item))
            {
              stringCounts[item]++;
            }
            else // If it's not in the dictionary, add it with a count of 1
            {
              stringCounts.Add(item, 1);
            }
          }
          winner += "Rock = " + stringCounts["R"].ToString() + System.Environment.NewLine;
          winner += "Paper = " + stringCounts["P"].ToString() + System.Environment.NewLine;
          winner += "Scissors = " + stringCounts["S"].ToString();
        }
      }
    }
  }
# ---------- end containment_7 ----------

# ----
merge = Merge(
    Data1=containment.oBehavior,
    Data2=containment_3.oBehavior,
    Data3=containment_2.oBehavior,
    Data4=containment_4.oBehavior,
    Data5=containment_5.oBehavior,
    Data6=containment_6.oBehavior,
    Data7=containment_7.oBehavior)

number_slider = Slider(11, range=0..999)
# Agent
lng = ListLength(List=pop2d)
c_script = CSharpScript(iCount=lng, x=number_slider)  # -> out, A, B, C; inputs iCount: Int32, x: Int32
# ---------- c_script: C# ----------
    List<double> X = new List<double>();
    List<double> Y = new List<double>();
    List<double> Z = new List<double>();
    Random random = new Random(x);
    double range = 0.1;
    for (int i = 0; i < iCount; i++){
      X.Add(range * (random.NextDouble() * 2.0 - 1.0));
      Y.Add(range * (random.NextDouble() * 2.0 - 1.0));
      Z.Add(range * (random.NextDouble() * 2.0 - 1.0));
    }
    A = X;
    B = Y;
    C = Z;
# ---------- end c_script ----------
c_script_2 = CSharpScript(
    x=lng,
    y=number_slider,
    Reference="C:\Users\ainho\AppData\Roaming\McNeel\Rhinoceros\packages\7.0\ABxM-Core\1.5.4\ABxM.Core.dll")  # -> out, A; inputs x: Int32, y: Int32
# ---------- c_script_2: C# usings ----------
using ABxM.Core.Agent;
# ---------- c_script_2: C# ----------
    Random random = new Random(y);

    List<string> types = new List<string>();

    for (int i = 0; i < x; i++)
    {
      int number = random.Next(0, 3);
      string type = "";

      if(number == 0)
        type = "R"; //'rock';
      else if (number == 1)
        type = "P";// 'paper'
      else
        type = "S"; // 'scissors'

      types.Add(type);

    }

    A = types;
# ---------- end c_script_2 ----------
vec = VectorXYZ(XComponent=c_script.A, YComponent=c_script.B, ZComponent=0)  # -> Vector, Length
c_script_3 = CSharpScript(
    K="Type",
    V=c_script_2.A,
    Reference="C:\Users\ainho\AppData\Roaming\McNeel\Rhinoceros\packages\7.0\ABxM-Core\1.5.4\ABxM.Core.dll")  # -> out, A; inputs K: String, V: list
# ---------- c_script_3: C# ----------
    List<Dictionary<string, object>> customData = new List<Dictionary<string, object>>();

    foreach(object myValue in V)
    {
      Dictionary<string, object> myData = new Dictionary<string, object>();
      myData.Add(K, myValue);
      customData.Add(myData);
    }


    A = customData;
# ---------- c_script_3: C# additional code ----------
  /// <summary>
  /// This method will be called once every solution, before any calls to RunScript.
  /// </summary>
  public override void BeforeRunScript()
  { }
  /// <summary>
  /// This method will be called once every solution, after any calls to RunScript.
  /// </summary>
  public override void AfterRunScript()
  { }
# ---------- end c_script_3 ----------
boid = DefineBoid(Positions=pop2d, Velocities=vec.Vector, Behaviors=merge, CustomData=c_script_3.A)

# ----
# AgentSystem
panel_3 = Panel("0.01")
boid_sys = DefineBoidSystem(BoidAgents=boid, DisplacementThreshold=panel_3, Timestep="0.2", MaxForce=3, MaxSpeed=2)

list = ValueList({"Step-by-Step Solver": 0, "Silent Solver": 1}, selected="Step-by-Step Solver")
run = BooleanToggle(False)

# ---- group: Step by Step
trigger = Trigger(Interval=-200, TimerInterval=200, Target=solver)  # disabled
reset = Button()

# ---- group: Silent
panel_4 = Panel("1000")

# ----
gate = StreamGate(Stream=run, Gate=list)  # -> Target0, Target1

# ----
# Solver
solver = StepByStepSolver(Reset=reset, Execute=gate.Target0, AgentSystems=boid_sys)  # -> DisplayGeometries, AllAgentSystems, IterationCount
solver_silent = SilentSolver(Execute=gate.Target1, AgentSystems=boid_sys, MaxIterationCount=panel_4)  # -> DisplayGeometries, AllAgentSystems, IterationCount

filter = StreamFilter(Gate=list, Stream0=solver.DisplayGeometries, Stream1=solver_silent.DisplayGeometries)
filter_2 = StreamFilter(Gate=list, Stream0=solver.AllAgentSystems, Stream1=solver_silent.AllAgentSystems)
filter_3 = StreamFilter(Gate=list, Stream0=solver.IterationCount, Stream1=solver_silent.IterationCount)

dispatch = Dispatch(List=filter, DispatchPattern=[True, False])  # -> ListA, ListB
vdis = VectorDisplay(Anchor=dispatch.ListA, Vector=dispatch.ListB)

c_script_4 = CSharpScript()  # -> out, oImages, oMasks
# ---------- c_script_4: C# usings ----------
using System.Linq;
# ---------- c_script_4: C# ----------
    string ghFilePath = Grasshopper.Instances.ActiveCanvas.Document.FilePath;
    string directoryPath = System.IO.Path.GetDirectoryName(ghFilePath) + "/img";

    oImages = images.Select(img => System.IO.Path.Combine(directoryPath, img)).ToList();
    oMasks = masks.Select(msk => System.IO.Path.Combine(directoryPath, msk)).ToList();
# ---------- c_script_4: C# additional code ----------
  List<string> images = new List<string>
    {
      @"paper.png",
      @"rock.png",
      @"scissor.png"
      };

  List<string> masks = new List<string>
    {
      @"paper_mask.png",
      @"rock_mask.png",
      @"scissor_mask.png"
      };
# ---------- end c_script_4 ----------
c_script_5 = CSharpScript(
    x=filter_2,
    y=c_script_4.oImages,
    z=c_script_4.oMasks,
    Reference="C:\Users\ainho\AppData\Roaming\McNeel\Rhinoceros\packages\7.0\ABxM-Core\1.5.4\ABxM.Core.dll")  # -> out, A, B, C; inputs y: list of String, z: list of String
# ---------- c_script_5: C# usings ----------
using ABxM.Core.AgentSystem;
using ABxM.Core.Agent;
# ---------- c_script_5: C# ----------
    List<string> types = new List<string>();
    List<string> paths = new List<string>();
    List<string> pathsMasks = new List<string>();

    BoidSystem AS = x as BoidSystem;

    if (AS != null)
    {
      foreach (var agent in AS.Agents)
      {
        object typeObj;
        if (agent.CustomData.TryGetValue("Type", out typeObj))
        {
          string type = null;
          if (typeObj is GH_String)
          {
            GH_String typeDummy = typeObj as GH_String;
            type = typeDummy.Value;
          }
          else if (typeObj is string)
          {
            type = typeObj as string;
          }
          else
          {
            continue; // Skip to the next iteration if typeObj isn't a string or GH_String
          }

          switch (type)
          {
            case "P":
              paths.Add(y[0]);
              pathsMasks.Add(z[0]);
              break;
            case "R":
              paths.Add(y[1]);
              pathsMasks.Add(z[1]);
              break;
            case "S":
              paths.Add(y[2]);
              pathsMasks.Add(z[2]);
              break;
            default:
              paths.Add("ERROR");
              pathsMasks.Add("ERROR");
              break;
          }
          types.Add(type);
        }
        else
        {
          this.Component.AddRuntimeMessage(GH_RuntimeMessageLevel.Error, "Cast Failed");
        }
      }
    }

    A = types;
    B = paths;
    C = pathsMasks;
# ---------- end c_script_5 ----------
xy = XYPlane(Origin=dispatch.ListA)
rectangle_2 = Rectangle(Plane=xy, XSize="-1 to 1", YSize="-1 to 1", Radius=0)  # -> Rectangle, Length
mplane = MeshPlane(Boundary=rectangle_2.Rectangle, WidthCount="1", HeightCount="1")  # -> Mesh, Area
planarmap = PlanarMapping(Mesh=mplane.Mesh, Plane=xy, XExtents="-1 to 1", YExtents="-1 to 1")  # -> MappedMesh, MappingPlane
previewmat = CustomPreviewMaterials(
    Geometry=planarmap.MappedMesh,
    DiffuseColor=RGB(255, 255, 255),
    DiffuseBitmap=c_script_5.B,
    TransparencyBitmap=c_script_5.C)

containment_8 = CSharpScript(
    iAS=filter_2,
    iReset=reset,
    Reference="C:\Users\ainho\AppData\Roaming\McNeel\Rhinoceros\packages\7.0\ABxM-Core\1.5.4\ABxM.Core.dll")  # -> out, A, B; inputs iReset: Boolean
# ---------- containment_8: C# ----------
    BoidSystem agentSystem = iAS as BoidSystem;
    List<string> outputTypes = new List<string>();
    DataTree<int> outputTypesList = new DataTree<int>();

    int rCount = 0;
    int pCount = 0;
    int sCount = 0;

    if(iReset)
    {
      rCount = 0;
      pCount = 0;
      sCount = 0;
      RList = new List<int>();
      PList = new List<int>();
      SList = new List<int>();
    }
    else
    {
      for (int i = 0; i < agentSystem.Agents.Count; i++)
      {
        string type = agentSystem.Agents[i].CustomData["Type"] as string;
        outputTypes.Add(type);
        if(type == "R") rCount += 1;
        if(type == "P") pCount += 1;
        if(type == "S") sCount += 1;
      }

      RList.Add(rCount);
      PList.Add(pCount);
      SList.Add(sCount);

      outputTypesList.AddRange(RList, new GH_Path(0));
      outputTypesList.AddRange(PList, new GH_Path(1));
      outputTypesList.AddRange(SList, new GH_Path(2));


      A = outputTypes;
      B = outputTypesList;
    }
# ---------- containment_8: C# additional code ----------
  private List<int> RList = new List<int>();
  private List<int> PList = new List<int>();
  private List<int> SList = new List<int>();
# ---------- end containment_8 ----------
graph = QuickGraph(containment_8.B, SortOrder=0)

# ----
# Display
ticks = Panel(filter_3)
