# Grasshopper definition Boids_Attract-to-Mouse_Behavior.gh (Grasshopper 1.0.7)
# plug-ins: ABxM.Grasshopper

# © 2021 by ICD University of Stuttgart
panel = Panel("0 to 50")
box = DomainBox(Base=PlaneXY(0, 0, 0), X=panel, Y=panel, Z="0 to 10")

# ----
# Attract-to-Mouse Behavior:
# If you hold down the left Alt key AND left mouse button and drag the mouse around the screen,
# you will see that the boids that are near the mouse cursor will steer toward the mouse.
number_slider = Slider(15, range=0..20)
c_script = CSharpScript(
    iMouseRange=number_slider,
    iWeight=Slider(1, range=0..1),
    Reference="C:\USERS\AINHO\APPDATA\ROAMING\MCNEEL\RHINOCEROS\PACKAGES\7.0\ABXM-CORE\1.5.4\ABxM.Core.dll")  # -> out, oBehavior; inputs iMouseRange: Double, iWeight: Double
# ---------- c_script: C# usings ----------
using ABxM.Core;
using ABxM.Core.Agent;
using ABxM.Core.AgentSystem;
using ABxM.Core.Behavior;
using ABxM.Core.Environments;
using ABxM.Core.Utilities;
# ---------- c_script: C# ----------
    behavior.MouseRange = iMouseRange;
    behavior.Weight = iWeight;

    oBehavior = behavior;
# ---------- c_script: C# additional code ----------
  MouseAttractionBehavior behavior = new MouseAttractionBehavior();

  public class MouseAttractionBehavior : BehaviorBase
  {
    public double MouseRange;


    public MouseAttractionBehavior()
    {
    }


    public override void Execute(AgentBase agent)
    {
      if (!MouseTracker.LeftMousePressed) return;

      Boid boid = (Boid) agent;

      Point3d closestPointOnMouseLine = MouseTracker.MouseLine.ClosestPoint(boid.Position, false);

      Vector3d attractToMouse = closestPointOnMouseLine - boid.Position;

      if (attractToMouse.Length < MouseRange)
      {
        attractToMouse.Unitize();
        attractToMouse *= boid.Velocity.Length;
        boid.AddForce(attractToMouse * Weight);
      }
    }
  }
# ---------- end c_script ----------

wires = BrepWireframe(Brep=box, Density=-1)
pop3d = Populate3D(Region=box, Count=100, Seed=1)
alignment_behavior = DefineAlignmentBehavior(AlignmentDistance="10", Weight=Slider(1, range=0..1))
separate = DefineSeparationBehavior(SeparationDistance="5", Weight=Slider(1, range=0..1), Power=1, AffectSelf=True)
lng = ListLength(List=pop3d)
c_script_2 = CSharpScript(iCount=lng)  # -> out, A, B, C; inputs iCount: Int32
# ---------- c_script_2: C# ----------
    List<double> X = new List<double>();
    List<double> Y = new List<double>();
    List<double> Z = new List<double>();
    Random random = new Random(5);
    double range = 0.1;
    for (int i = 0; i < iCount; i++){
      X.Add(range * (random.NextDouble() * 2.0 - 1.0));
      Y.Add(range * (random.NextDouble() * 2.0 - 1.0));
      Z.Add(range * (random.NextDouble() * 2.0 - 1.0));
    }
    A = X;
    B = Y;
    C = Z;
# ---------- end c_script_2 ----------
vec = VectorXYZ(XComponent=c_script_2.A, YComponent=c_script_2.B, ZComponent=0)  # -> Vector, Length
unit = UnitVector(Vector=vec.Vector)
boid = DefineBoid(Positions=pop3d, Velocities=unit, Behaviors=[separate, alignment_behavior, c_script.oBehavior])
panel_2 = Panel(unit)
boid_sys = DefineBoidSystem(BoidAgents=boid, DisplacementThreshold="0.001", Timestep="0.1", MaxForce=3, MaxSpeed=0.5)
solver = StepByStepSolver(Reset=Button(), Execute=Toggle(False), AgentSystems=boid_sys)  # -> DisplayGeometries, AllAgentSystems, IterationCount
python = GhPythonScript(x=solver.AllAgentSystems)  # -> out, a
# ---------- python: Python ----------
if x:
    vels = []
    for agent in x.Agents:
        vels.append(agent.Velocity)
    a = vels
# ---------- end python ----------
panel_3 = Panel(solver.IterationCount)
panel_4 = Panel(python.a)
dispatch = Dispatch(List=solver.DisplayGeometries, DispatchPattern=[True, False])  # -> ListA, ListB
c_script_3 = CSharpScript(
    BS=solver.AllAgentSystems,
    Reference="C:\Users\ainho\AppData\Roaming\McNeel\Rhinoceros\packages\7.0\ABxM-Core\1.5.4\ABxM.Core.dll")  # -> out, A
# ---------- c_script_3: C# usings ----------
using ABxM.Core;
using ABxM.Core.Agent;
using ABxM.Core.AgentSystem;
using ABxM.Core.Behavior;
using ABxM.Core.Environments;
# ---------- c_script_3: C# ----------
    Vector3d totalDisplacement = Vector3d.Zero;

    var system = (BoidSystem) BS;

    foreach (Boid agent in  system.Agents)
      totalDisplacement += agent.Velocity;

    A = totalDisplacement.Length;
# ---------- end c_script_3 ----------
total_displacement = Panel(c_script_3.A)
vdis = VectorDisplay(Anchor=dispatch.ListA, Vector=dispatch.ListB)
