# Grasshopper definition UR10e_BaseCode.gh (Grasshopper 1.0.7)
# plug-ins: ABxM.Grasshopper, Pufferfish, ABxM.IAAC, Wombat, Human, Heteroptera

# ---- group: Makes all Robot Bools False on Opening (Do not move)
c_script = CSharpScript()  # -> out, A
# ---------- c_script: C# usings ----------
using System.Linq;
using Grasshopper.Kernel.Special;
# ---------- c_script: C# ----------
    OnCloseDocument();
# ---------- c_script: C# additional code ----------
  private void OnCloseDocument()
  {
    string targetName = "Robot";
    var doc = Grasshopper.Instances.ActiveCanvas.Document;

    if (doc != null)
    {
      var booleanComponents = doc.Objects.OfType<GH_BooleanToggle>()
        .Where(bt => bt.NickName.Contains(targetName));

      foreach (var booleanComponent in booleanComponents)
      {
        booleanComponent.Value = false;
        booleanComponent.ExpireSolution(true);
      }
    }
  }
# ---------- end c_script ----------

# ----
# ABxM
timed_trigger = Trigger(Interval=10000, TimerInterval=10000, Target=solver)  # disabled
simulation_run_abxm = BooleanToggle(True)
# © 2024 by ICD University of Stuttgart
# CONTROLS
reset_abxm = Button()

# ----
# Robot Control
list = ValueList({"Rob-1 (smallTable)": 0, "Rob-2 (bigTable)": 1}, selected="Rob-2 (bigTable)")
c_script_2 = CSharpScript(iCell=list)  # -> out, oIP, oSafePoint, oTowerBase, oPickBase, oType; inputs iCell: Int32
# ---------- c_script_2: C# ----------
    if(iCell == 0) // Rob-1 (small Table)
    {
      oIP = "192.168.56.101";
      oSafePoint = new Point3d(-852, -203, 613);
      oTowerBase = new Point3d(-963, 59, 85);
      oPickBase = new Point3d(-657, -425, 45);
      oType = 0;

    }
    else if(iCell == 1) // Rob-2 (big Table)
    {
      oIP = "192.168.1.1";
      oSafePoint = new Point3d(243, -1010, 500); //_GR
      oTowerBase = new Point3d(-278, -794, 40);
      oPickBase = new Point3d(205, -1010, 30);
      oType = 1;

    }
    else
    {
      this.Component.AddRuntimeMessage(GH_RuntimeMessageLevel.Error, "I dont know this Cell, 0 or 1");
    }
# ---------- end c_script_2 ----------
robot_ip_address = Panel(c_script_2.oIP)
otowerbase = Panel(c_script_2.oTowerBase)
opickbase = Panel(c_script_2.oPickBase)

# ----
# Robot Path
path_division_length_mm = Slider(50, range=0..100)
drop_plane_offset = Slider(5, range=0..10)
block_height = Slider(15, range=0..100)
half_mode = BooleanToggle(True)

# ----
# MQTT
activate = BooleanToggle(False)
mqttsubscribe = MQTTSubscribe(Activate=activate, Host="mqtt-dashboard.com", Port="1883", Topic="IAACWorkshop/Gestures/Test")  # -> Status, Topics, Messages
panel = Panel(mqttsubscribe.Messages)
data = Data(panel)

send_commands_to_robot = BooleanToggle(False)
visulaize_real_robot = BooleanToggle(False)
run_robot = BooleanToggle(False)

safe_point = Panel(c_script_2.oSafePoint)

cluster = Cluster_2(tower_base=otowerbase, num=block_height, pick_pt=opickbase)  # -> O, i, C, W

midpt = CurveMiddle(Curve=cluster.W)
pdecon = Deconstruct(Point=midpt)  # -> XComponent, YComponent, ZComponent
extremums = MinMax(Number=flatten(pdecon.ZComponent))  # -> Minimum, Maximum
gradient = Gradient(
    LowerLimit=extremums.Minimum,
    UpperLimit=extremums.Maximum,
    Parameter=pdecon.ZComponent,
    stops=[0: RGB(0, 128, 0), 0.5: RGB(255, 255, 0), 1: RGB(255, 0, 0)])
previewlw = CustomPreviewLineweights(Geometry=cluster.W, Shader=gradient, Thickness=Slider(1, range=0..10), Absolute=False)

pframe = PerpFrame(Curve=reparameterize(graft(cluster.C)), Parameter=[0, 1])
divdist = DivideDistance(Curve=cluster.C, Distance=path_division_length_mm)  # -> Points, Tangents, Parameters
ins = InsertItems(List=pframe, Item=divdist.Points, Indices=1, Wrap=True)
cullpt = CullDuplicates(Points=ins, Tolerance=0.01, CullMode=1)  # -> Points, Indices, Valence
pline = PolyLine(Vertices=cullpt.Points, Closed=False)  # -> flatten(Polyline)

# ----
# Tower & Path Generation
toggle = BooleanToggle(False)

simulate = BooleanToggle(False)
list_2 = ValueList({"Open_Palm", "ILoveYou", "Nothing"}, selected="Nothing")
panel_2 = Panel(data)
panel_3 = Panel(list_2)
# Sensor Behaviors - On/Off
filter = StreamFilter(Gate=simulate, Stream0=panel_2, Stream1=panel_3)

simulate_2 = BooleanToggle(False)
list_3 = ValueList({"Thumb_Up", "Nothing"}, selected="Nothing")
panel_4 = Panel(list_3)
panel_5 = Panel(data)
filter_2 = StreamFilter(Gate=simulate_2, Stream0=panel_5, Stream1=panel_4)

simulate_3 = BooleanToggle(False)
list_4 = ValueList({"Closed_Fist", "Nothing"}, selected="Nothing")
panel_6 = Panel(data)
panel_7 = Panel(list_4)
filter_3 = StreamFilter(Gate=simulate_3, Stream0=panel_6, Stream1=panel_7)

simulate_4 = BooleanToggle(True)
list_5 = ValueList({"Nothing", "Thumb_Down", "ILoveYou", "Thumb_Up", "Victory"}, selected="Nothing")
panel_8 = Panel(data)
panel_9 = Panel(list_5)
filter_4 = StreamFilter(Gate=simulate_4, Stream0=panel_8, Stream1=panel_9)

simulate_5 = BooleanToggle(False)
list_6 = ValueList({"Victory", "Nothing"}, selected="Nothing")
panel_10 = Panel(data)
panel_11 = Panel(list_6)
filter_5 = StreamFilter(Gate=simulate_5, Stream0=panel_10, Stream1=panel_11)

# ----
# Behavior - Sensor Blocking
number_slider = Slider(60, range=0..100)
Y = UnitY(Factor=number_slider)
X = UnitX(Factor=number_slider)
neg = Negative(Value=X)
neg_2 = Negative(Value=Y)
merge = Merge(Data1=X, Data2=Y, Data3=neg, Data4=neg_2)
c_script_3 = CSharpScript(x=filter_5)  # -> out, A; inputs x: String
# ---------- c_script_3: C# ----------
    if(x == "Victory") A = true;
    else A = false;
# ---------- end c_script_3 ----------
separation = CSharpScript(
    iSensorValue=c_script_3.A,
    iVectors=merge,
    iWeight=Slider(838, range=0..1000),
    Reference=["C:\USERS\LASAT\APPDATA\ROAMING\MCNEEL\RHINOCEROS\PACKAGES\7.0\ABXM-CORE\1.5.4\ABxM.Core.dll", "C:\USERS\LASAT\APPDATA\ROAMING\GRASSHOPPER\LIBRARIES\ABxM.IAAC.Core.dll"])  # -> out, oBehavior; inputs iSensorValue: Boolean, iVectors: list of Vector3d, iWeight: Double
# ---------- separation: C# usings ----------
using ABxM.Core;
using ABxM.Core.Agent;
using ABxM.Core.AgentSystem;
using ABxM.Core.Behavior;
using ABxM.Core.Environments;

using ABxM.IAAC.Core.Agent;
using ABxM.IAAC.Core.AgentSystem;
# ---------- separation: C# ----------
    behavior.sensor = iSensorValue;
    behavior.vectors = iVectors;
    behavior.Weight = iWeight;
    oBehavior = behavior;
# ---------- separation: C# additional code ----------
  SensorBehavior behavior = new SensorBehavior();

  public class SensorBehavior : BehaviorBase
  {

    public bool sensor = false;
    public List<Vector3d> vectors;

    public override void Execute(AgentBase agent)
    {
      PlaneAgent planeAgent = (PlaneAgent) agent;

      if (sensor == false)
      {
        planeAgent.NewCustomData["SensorIteration"] = 0;
      }

      if (sensor != (bool) planeAgent.NewCustomData["Sensor"])
      {
        planeAgent.NewCustomData["Sensor"] = sensor;
      }

      int sensorValue = (int) planeAgent.CustomData["SensorIteration"];


      if ((bool) planeAgent.CustomData["Sensor"])
      {
        Vector3d vect = vectors[sensorValue];
        Plane newPlane = Plane.WorldXY;
        newPlane.Origin = planeAgent.Position.Origin;
        vect.Transform(Transform.PlaneToPlane(Plane.WorldXY, newPlane));

        planeAgent.Moves.Add(vect);
        planeAgent.Weights.Add(Weight);
        planeAgent.NewCustomData["SensorIteration"] = sensorValue + 1;
        if (sensorValue == vectors.Count - 1)
        {
          planeAgent.NewCustomData["SensorIteration"] = 0;
        }

      }
    }
  }
# ---------- end separation ----------

# ----
# Sensor Behaviors - Dynamic
# Behavior - Rotate
number_slider_2 = Slider(76, range=0..100)
add_rotation = CSharpScript(
    iWeight=number_slider_2,
    iEnable=Toggle(False),
    iAngle=Slider(10, range=0..100),
    Reference=["C:\USERS\LASAT\APPDATA\ROAMING\MCNEEL\RHINOCEROS\PACKAGES\7.0\ABXM-CORE\1.5.4\ABxM.Core.dll", "C:\USERS\LASAT\APPDATA\ROAMING\GRASSHOPPER\LIBRARIES\ABxM.IAAC.Core.dll"])  # -> out, oBehavior; inputs iWeight: Double, iEnable: Boolean, iAngle: Double
# ---------- add_rotation: C# ----------
    behavior.Enable = iEnable;
    behavior.angle = iAngle;
    behavior.Weight = iWeight;
    if(behavior.CustomData.ContainsKey("Trigger"))
      behavior.CustomData["Trigger"] = new GH_Boolean(false);
    else
      behavior.CustomData.Add("Trigger", new GH_Boolean(false));
    oBehavior = behavior;
# ---------- add_rotation: C# additional code ----------
  AddRotationBehavior behavior = new AddRotationBehavior();
  public class AddRotationBehavior : BehaviorBase
  {

    public bool Enable;
    public Double angle;

    public override void Execute(AgentBase agent)
    {
      if(Enable)
      {
        PlaneAgent planeAgent = (PlaneAgent) agent;
        int step = (int) planeAgent.CustomData["PauseCount"];
        GH_Boolean trigger = (GH_Boolean) this.CustomData["Trigger"];

        if (trigger.Value)
        {
          if (step == 0 && (bool) planeAgent.CustomData["Pick"] == false && (bool) planeAgent.CustomData["Place"] == false )
          {
            Plane plane1 = planeAgent.Position;
            Plane plane2 = planeAgent.Position;
            plane2.Rotate(angle * Math.PI / 180, plane2.Normal, plane2.Origin);
            Quaternion moveQuaternion = Quaternion.Rotation(plane1, plane2);

            planeAgent.Rotations.Add(moveQuaternion);
            planeAgent.RWeights.Add(Weight);
          }
        }
      }
    }
  }
# ---------- end add_rotation ----------
c_script_4 = CSharpScript(x=filter_2)  # -> out, A; inputs x: String
# ---------- c_script_4: C# ----------
    if(x == "Thumb_Up") A = true;
    else A = false;
# ---------- end c_script_4 ----------
update_behaviour = UpdateBehaviour(Behavior=add_rotation.oBehavior, Key="Trigger", Value=c_script_4.A)  # -> Status, Behavior

# ----
# Behavior - Move XY
number_slider_3 = Slider(283, range=0..1000)
add_rotation_2 = CSharpScript(
    iWeight=number_slider_3,
    iEnable=Toggle(False),
    Reference=["C:\USERS\LASAT\APPDATA\ROAMING\MCNEEL\RHINOCEROS\PACKAGES\7.0\ABXM-CORE\1.5.4\ABxM.Core.dll", "C:\USERS\LASAT\APPDATA\ROAMING\GRASSHOPPER\LIBRARIES\ABxM.IAAC.Core.dll"])  # -> out, oBehavior; inputs iWeight: Double, iEnable: Boolean
# ---------- add_rotation_2: C# ----------
    behavior.Enable = iEnable;
    if(behavior.CustomData.ContainsKey("Trigger"))
      behavior.CustomData["Trigger"] = new GH_Boolean(false);
    else
      behavior.CustomData.Add("Trigger", new GH_Boolean(false));

    behavior.Weight = iWeight;
    oBehavior = behavior;
# ---------- add_rotation_2: C# additional code ----------
  AddMoveXYBehavior behavior = new AddMoveXYBehavior();

  public class AddMoveXYBehavior : BehaviorBase
  {

    public bool Enable;

    public override void Execute(AgentBase agent)
    {
      PlaneAgent planeAgent = (PlaneAgent) agent;
      if(Enable)
      {
        int step = (int) planeAgent.CustomData["PauseCount"];
        GH_Integer triggerGH = (GH_Integer) this.CustomData["Trigger"];
        int trigger = triggerGH.Value;

        if (trigger != 0)
        {
          if (step == 0 && (bool) planeAgent.CustomData["Pick"] == false && (bool) planeAgent.CustomData["Place"] == false )
          {
            if (trigger == 1)
            {
              Vector3d moveAway = Vector3d.XAxis;
              planeAgent.Moves.Add(moveAway);
              planeAgent.Weights.Add(Weight);
            }
            else if (trigger == 2)
            {
              Vector3d moveAway = -1 * Vector3d.XAxis;
              planeAgent.Moves.Add(moveAway);
              planeAgent.Weights.Add(Weight);
            }
            else if (trigger == 3)
            {
              Vector3d moveAway = Vector3d.YAxis;
              planeAgent.Moves.Add(moveAway);
              planeAgent.Weights.Add(Weight);
            }
            else if (trigger == 4)
            {
              Vector3d moveAway = -1 * Vector3d.YAxis;
              planeAgent.Moves.Add(moveAway);
              planeAgent.Weights.Add(Weight);
            }
          }
        }
      }
    }
  }
# ---------- end add_rotation_2 ----------
c_script_5 = CSharpScript(x=filter_4)  # -> out, A; inputs x: String
# ---------- c_script_5: C# ----------
    if(x == "Thumb_Down") A = 1;
    else if(x == "Thumb_Up") A = 2;
    else if(x == "ILoveYou") A = 3;
    else if(x == "Victory") A = 4;
    else A = 0;
# ---------- end c_script_5 ----------
update_behaviour_2 = UpdateBehaviour(Behavior=add_rotation_2.oBehavior, Key="Trigger", Value=c_script_5.A)  # -> Status, Behavior

# ----
# Behavior -Tween
number_slider_4 = Slider(0.1, range=0..1)
tween = CSharpScript(
    iWeight=Slider(5, range=0..10),
    iTweenPercentage=number_slider_4,
    Reference=["C:\USERS\LASAT\APPDATA\ROAMING\MCNEEL\RHINOCEROS\PACKAGES\7.0\ABXM-CORE\1.5.4\ABxM.Core.dll", "C:\USERS\LASAT\APPDATA\ROAMING\GRASSHOPPER\LIBRARIES\ABxM.IAAC.Core.dll"])  # -> out, oBehavior; inputs iWeight: Double, iTweenPercentage: Double
# ---------- tween: C# ----------
    behavior.Weight = iWeight;
    behavior.tweenPercentage = iTweenPercentage;
    oBehavior = behavior;
# ---------- tween: C# additional code ----------
  CurveTweenBehavior behavior = new CurveTweenBehavior();

  public class CurveTweenBehavior : BehaviorBase
  {
    public List<Plane> Planes;
    public List<Polyline> Path;
    public Plane PickPlane;
    public double tweenPercentage = 0.75;

    public override void Execute(AgentBase agent)
    {
      PlaneAgent planeAgent = (PlaneAgent) agent;
      PlaneAgentSystem system = (PlaneAgentSystem) (planeAgent.AgentSystem);
      CartesianEnvironment env = system.CartesianEnvironment;
      Path = (List<Polyline>) env.CustomData["Paths"];
      Planes = (List<Plane>) env.CustomData["TimberGoal"];
      int step = (int) planeAgent.CustomData["PauseCount"];

      int curveIndex = (int) planeAgent.CustomData["CurrentCurve"];

      if (curveIndex < Path.Count && step == 0)
      {
        Polyline currentCurve = Path[curveIndex];

        int closestIndex = currentCurve.ClosestIndex(planeAgent.Position.Origin);
        bool gripper = (bool) planeAgent.CustomData["Gripper"];

        //Check Robot Conditiond for moving
        if ((bool) planeAgent.CustomData["Pick"] == false && (bool) planeAgent.CustomData["Place"] == false && (bool) planeAgent.CustomData["Sensor"] == false)
        {
          Quaternion moveQuaternion = Quaternion.Identity;
          if (gripper == false)
          {
            //Tweening between Planes
            //
            //
            int newIndex = closestIndex - 1;
            if (curveIndex < ((List<Polyline>) env.CustomData["Paths"]).Count - 1)
            {
              if (newIndex / (double) currentCurve.Count > tweenPercentage)
              {
                PickPlane = ((List<Plane>) env.CustomData["Timber"])[curveIndex];
                Plane plane1 = planeAgent.Position;
                Plane plane2 = PickPlane;
                //plane2.Flip();
                Plane plane3 = PickPlane;
                plane3.Rotate(Math.PI, Vector3d.ZAxis, plane3.Origin);
                //plane3.Flip();

                double angle1 = Vector3d.VectorAngle(plane1.XAxis, plane3.XAxis);
                double angle2 = Vector3d.VectorAngle(plane1.XAxis, plane2.XAxis);

                // Choose the rotation with the smaller angle
                if (angle1 < angle2)
                {
                  moveQuaternion = Quaternion.Rotation(plane1, plane3);
                }
                else
                {
                  moveQuaternion = Quaternion.Rotation(plane1, plane2);
                }

                double perctangeToTween = ((double) currentCurve.Count - newIndex) / ((double) currentCurve.Count * (1 - tweenPercentage));
                double angle = 2 * Math.Acos(moveQuaternion.A);
                double scaledAngle = angle * perctangeToTween;
                if (scaledAngle > 0.001)
                {
                  Quaternion scaledQuaternion = Quaternion.Rotation(scaledAngle, moveQuaternion.Vector);
                  moveQuaternion = scaledQuaternion;
                }
                else
                {
                  moveQuaternion = Quaternion.Identity;
                }
              }
            }
          }
          else
          {
            //Tweening between Planes
            //
            //
            int newIndex = closestIndex + 1;
            if (newIndex / (double) currentCurve.Count > tweenPercentage)
            {
              Plane plane1 = planeAgent.Position;
              Plane plane2 = Planes[curveIndex];
              plane2.Flip();
              Plane plane3 = Planes[curveIndex];
              plane3.Rotate(Math.PI, Vector3d.ZAxis, plane3.Origin);
              plane3.Flip();

              double angle1 = Vector3d.VectorAngle(plane1.XAxis, plane3.XAxis);
              double angle2 = Vector3d.VectorAngle(plane1.XAxis, plane2.XAxis);
              // Choose the rotation with the smaller angle
              if (angle1 < angle2)
              {
                moveQuaternion = Quaternion.Rotation(plane1, plane3);
              }
              else
              {
                moveQuaternion = Quaternion.Rotation(plane1, plane2);
              }
              double perctangeToTween = 1 - ((double) currentCurve.Count - newIndex) / ((double) currentCurve.Count * (1 - tweenPercentage));
              double angle = 2 * Math.Acos(moveQuaternion.A);
              double scaledAngle = angle * perctangeToTween;
              if (scaledAngle > 0.001)
              {
                Quaternion scaledQuaternion = Quaternion.Rotation(scaledAngle, moveQuaternion.Vector);
                moveQuaternion = scaledQuaternion;
              }
              else
              {
                moveQuaternion = Quaternion.Identity;
              }
            }
          }
          planeAgent.Rotations.Add(moveQuaternion);
          planeAgent.RWeights.Add(Weight);
        }
      }
    }

    public static Quaternion ScaleQuaternion(Quaternion quaternion, double scaleFactor)
    {
      return new Quaternion(quaternion.A * scaleFactor, quaternion.B * scaleFactor,
        quaternion.C * scaleFactor, quaternion.D * scaleFactor);
    }
  }
# ---------- end tween ----------

# ----
# Behavior - Curves
number_slider_5 = Slider(100, range=0..1000)
# Core Behaviors
number_slider_6 = Slider(8.6, range=0..10)
curve = CSharpScript(
    iWeight=number_slider_6,
    iPower=Slider(1, range=0..1),
    iSafteyDistance=number_slider_5,
    Reference=["C:\USERS\LASAT\APPDATA\ROAMING\MCNEEL\RHINOCEROS\PACKAGES\7.0\ABXM-CORE\1.5.4\ABxM.Core.dll", "C:\USERS\LASAT\APPDATA\ROAMING\GRASSHOPPER\LIBRARIES\ABxM.IAAC.Core.dll"])  # -> out, oBehavior; inputs iWeight: Double, iPower: Double, iSafteyDistance: Double
# ---------- curve: C# ----------
    behavior.Weight = iWeight;
    behavior.Power = iPower;
    behavior.SafteyDistance = iSafteyDistance;
    oBehavior = behavior;
# ---------- curve: C# additional code ----------
  CurveFollowBehavior behavior = new CurveFollowBehavior();

  public class CurveFollowBehavior : BehaviorBase
  {
    public List<Polyline> Path;
    public double SafteyDistance = 100;
    public double Power = 1;
    public bool FirstRun = true;


    public CurveFollowBehavior()
    {
      Weight = 1.0;
    }

    public override void Execute(AgentBase agent)
    {
      PlaneAgent planeAgent = (PlaneAgent) agent;
      PlaneAgentSystem system = (PlaneAgentSystem) (planeAgent.AgentSystem);
      CartesianEnvironment env = system.CartesianEnvironment;
      Path = (List<Polyline>) env.CustomData["Paths"];
      int step = (int) planeAgent.CustomData["PauseCount"];
      int curveIndex = (int) planeAgent.CustomData["CurrentCurve"];

      if(this.Solver.IterationCount == 1) FirstRun = true;
      //RhinoApp.WriteLine("AAA");

      //      if(curveIndex == 1 && FirstRun && step != 0)
      //      {
      //        curveIndex = curveIndex - 1;
      //        FirstRun = false;
      //
      //      }

      //RhinoApp.WriteLine("Path = " + Path.Count.ToString() + " curveIndex = " + curveIndex.ToString() + " FirstRun = " + FirstRun.ToString());

      if (curveIndex < Path.Count && step == 0 )
      {
        //RhinoApp.WriteLine("A");
        Polyline currentCurve = Path[curveIndex];
        int closestIndex = currentCurve.ClosestIndex(planeAgent.Position.Origin);
        bool gripper = (bool) planeAgent.CustomData["Gripper"];

        //Check Robot Conditiond for moving
        if ((bool) planeAgent.CustomData["Pick"] == false && (bool) planeAgent.CustomData["Place"] == false && (bool) planeAgent.CustomData["Sensor"] == false)
        {
          Vector3d moveAway = currentCurve[closestIndex] - planeAgent.Position.Origin;
          //RhinoApp.WriteLine("B");

          if (gripper == false)
          {
            int newIndex = closestIndex - 1;
            moveAway = currentCurve[newIndex] - planeAgent.Position.Origin;
            //RhinoApp.WriteLine("C");

            if(newIndex == 0 && currentCurve.PointAt(newIndex).DistanceTo(planeAgent.Position.Origin) < 0.05)
              Power = 0.1;
            //Stop in order to perform gripping action
            if (newIndex == 0)
            {
              //RhinoApp.WriteLine("D");

              planeAgent.NewCustomData["Place"] = true;
              planeAgent.NewCustomData["Pick"] = false;
              //              if(FirstRun)
              //              {
              //                planeAgent.NewCustomData["CurrentCurve"] = curveIndex;
              //                FirstRun = true;
              //                RhinoApp.WriteLine("D");
              //
              //              }
              //              else
              //              {
              planeAgent.NewCustomData["CurrentCurve"] = curveIndex + 1;
              //RhinoApp.WriteLine("E");

              //              }
              //RhinoApp.WriteLine("____curveIndex = " + curveIndex.ToString() + " FirstRun = " + FirstRun.ToString());

            }
          }
          else
          {
            int newIndex = closestIndex + 1;
            moveAway = currentCurve[closestIndex + 1] - planeAgent.Position.Origin;

            //Stop in order to perform gripping action
            if (newIndex == Path[curveIndex].Count - 1)
            {
              planeAgent.NewCustomData["Pick"] = true;
              planeAgent.NewCustomData["Place"] = false;
            }
          }

          planeAgent.Moves.Add(moveAway*Power);
          if (planeAgent.Position.Origin.DistanceTo(currentCurve[0]) < SafteyDistance || planeAgent.Position.Origin.DistanceTo(currentCurve[currentCurve.Count - 1]) < SafteyDistance )
          {
            planeAgent.Weights.Add(100000);
          }
          else
          {
            planeAgent.Weights.Add(Weight);
          }

        }
      }
      if(curveIndex == Path.Count)
      {
        if(planeAgent.StartPosition.Origin.DistanceTo(planeAgent.Position.Origin) < RhinoDoc.ActiveDoc.ModelAbsoluteTolerance)
          this.Solver.CancelExecution();
        else
        {
          Vector3d moveAway = planeAgent.StartPosition.Origin - planeAgent.Position.Origin;
          moveAway *= 0.1;
          planeAgent.Moves.Add(moveAway);
          planeAgent.Weights.Add(Weight);
        }
      }
    }
  }
# ---------- end curve ----------

# ----
# Behavior - Pick/Place Pause
number_slider_7 = Slider(100, range=0..100)
pick_place_pause = CSharpScript(
    iTime=Slider(6, range=0..30),
    iGripperOffset=Slider(3, range=0..30),
    iClearDistance=number_slider_7,
    Reference=["C:\USERS\LASAT\APPDATA\ROAMING\MCNEEL\RHINOCEROS\PACKAGES\7.0\ABXM-CORE\1.5.4\ABxM.Core.dll", "C:\USERS\LASAT\APPDATA\ROAMING\GRASSHOPPER\LIBRARIES\ABxM.IAAC.Core.dll"])  # -> out, oBehavior; inputs iTime: Int32, iGripperOffset: Int32, iClearDistance: Double
# ---------- pick_place_pause: C# ----------
    if(iGripperOffset > iTime) this.Component.AddRuntimeMessage(GH_RuntimeMessageLevel.Error, "iGripperOffset is larger than iTime");
    behavior.count = iTime;
    behavior.offset = iGripperOffset;
    behavior.clearDistance = iClearDistance;

    oBehavior = behavior;
# ---------- pick_place_pause: C# additional code ----------
  PickPlaceBehavior behavior = new PickPlaceBehavior();

  public class PickPlaceBehavior : BehaviorBase
  {
    public int count = 10;  /*10 itterations of the solver*/
    public int offset = 10;
    public double clearDistance = 100;
    public override void Execute(AgentBase agent)
    {
      PlaneAgent planeAgent = (PlaneAgent) agent;
      bool gripper = (bool) planeAgent.CustomData["Gripper"];
      int step = (int) planeAgent.CustomData["PauseCount"];


      if ((bool) planeAgent.CustomData["Pick"] || (bool) planeAgent.CustomData["Place"] || step < 0)
      {
        step = step + 1;

        if (step == -1)
        {
          Vector3d moveAway = Vector3d.ZAxis * clearDistance;
          planeAgent.Moves.Add(moveAway);
          planeAgent.Weights.Add(clearDistance);
        }


        if (step == count - offset)
        {
          gripper = !gripper;
          planeAgent.NewCustomData["Gripper"] = gripper;

          planeAgent.NewCustomData["Pick"] = false;
          planeAgent.NewCustomData["Place"] = false;
          step = -1 * offset;
        }
        planeAgent.NewCustomData["PauseCount"] = step;
      }
    }
  }
# ---------- end pick_place_pause ----------

# ----
# Behavior - End Safety Orient
number_slider_8 = Slider(10000, range=0..10000)
safety_behavior = CSharpScript(
    iSafetyDistance=number_slider_5,
    iWeight=number_slider_8,
    Reference=["C:\USERS\LASAT\APPDATA\ROAMING\MCNEEL\RHINOCEROS\PACKAGES\7.0\ABXM-CORE\1.5.4\ABxM.Core.dll", "C:\USERS\LASAT\APPDATA\ROAMING\GRASSHOPPER\LIBRARIES\ABxM.IAAC.Core.dll"])  # -> out, oBehavior; inputs iSafetyDistance: Double, iWeight: Double; disabled
# ---------- safety_behavior: C# ----------
    behavior.safetyDistance = iSafetyDistance;
    behavior.Weight = iWeight;
    oBehavior = behavior;
# ---------- safety_behavior: C# additional code ----------
  SafetyBehavior behavior = new SafetyBehavior();

  public class SafetyBehavior : BehaviorBase
  {

    public Point3d pointAssembly;
    public Point3d pointPick;
    public Double safetyDistance;
    public List<Plane> Planes;
    public Plane PickPlane;

    public override void Execute(AgentBase agent)
    {
      PlaneAgent planeAgent = (PlaneAgent) agent;
      PlaneAgentSystem system = (PlaneAgentSystem) (planeAgent.AgentSystem);
      CartesianEnvironment env = system.CartesianEnvironment;
      int curveIndex = (int) planeAgent.CustomData["CurrentCurve"];


      if (curveIndex < ((List<Polyline>) env.CustomData["Paths"]).Count - 1)
      {
        Polyline currentCurve = ((List<Polyline>) env.CustomData["Paths"])[curveIndex];

        pointPick = currentCurve[0];
        pointAssembly = currentCurve[currentCurve.Count - 1];

        Quaternion moveQuaternion = Quaternion.Identity;
        if (planeAgent.Position.Origin.DistanceTo(pointPick) < safetyDistance)
        {
          PickPlane = ((List<Plane>) env.CustomData["Timber"])[curveIndex];
          Plane plane1 = planeAgent.Position;
          Plane plane2 = PickPlane;
          moveQuaternion = Quaternion.Rotation(plane1, plane2);

          planeAgent.Rotations.Add(moveQuaternion);
          planeAgent.RWeights.Add(Weight);

        }

        if (planeAgent.Position.Origin.DistanceTo(pointAssembly) < safetyDistance)
        {
          Planes = (List<Plane>) env.CustomData["TimberGoal"];

          Plane plane1 = planeAgent.Position;
          Plane plane2 = Planes[curveIndex];
          plane2.Flip();
          moveQuaternion = Quaternion.Rotation(plane1, plane2);

          planeAgent.Rotations.Add(moveQuaternion);
          planeAgent.RWeights.Add(Weight);
        }
      }



    }
  }
# ---------- end safety_behavior ----------

# ----
# Behavior - Containment
number_slider_9 = Slider(60, range=0..100)
brep = Brep(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)
containment = CSharpScript(
    iWeight=number_slider_9,
    iContainmentVolume=brep,
    Reference=["C:\USERS\LASAT\APPDATA\ROAMING\MCNEEL\RHINOCEROS\PACKAGES\7.0\ABXM-CORE\1.5.4\ABxM.Core.dll", "C:\USERS\LASAT\APPDATA\ROAMING\GRASSHOPPER\LIBRARIES\ABxM.IAAC.Core.dll"])  # -> out, oBehavior; inputs iWeight: Double, iContainmentVolume: Brep; disabled
# ---------- containment: C# ----------
    behavior.Weight = iWeight;
    behavior.containmentRegion = iContainmentVolume;
    oBehavior = behavior;
# ---------- containment: C# additional code ----------
  ContainmentBehavior behavior = new ContainmentBehavior();

  public class ContainmentBehavior : BehaviorBase
  {
    public Brep containmentRegion;

    public override void Execute(AgentBase agent)
    {
      PlaneAgent planeAgent = (PlaneAgent) agent;

      bool contianed = containmentRegion.IsPointInside(planeAgent.Position.Origin, 0.1, true);
      if (!contianed)
      {
        Point3d closestPoint = containmentRegion.ClosestPoint(planeAgent.Position.Origin);
        Vector3d moveAway = closestPoint - planeAgent.Position.Origin;
        planeAgent.Moves.Add(moveAway);
        planeAgent.Weights.Add(Weight);
      }

    }
  }
# ---------- end containment ----------

c_script_6 = CSharpScript(x=filter)  # -> out, A; inputs x: String
# ---------- c_script_6: C# ----------
    if(x == "Open_Palm") A = 0;
    else if(x == "ILoveYou") A = 1;
    else A = 2;
# ---------- end c_script_6 ----------
c_script_7 = CSharpScript(x=filter_3)  # -> out, A; inputs x: String
# ---------- c_script_7: C# ----------
    if(x == "Closed_Fist") A = true;
    else A = false;
# ---------- end c_script_7 ----------

# ----
# Behavior - Move
number_slider_10 = Slider(9.5, range=0..10)
Y_2 = UnitY(Factor=Slider(44, range=0..100))
neg_3 = Negative(Value=Y_2)
add_rotation_3 = CSharpScript(
    iWeight=number_slider_10,
    iEnable=Toggle(False),
    iVector=neg_3,
    Reference=["C:\USERS\LASAT\APPDATA\ROAMING\MCNEEL\RHINOCEROS\PACKAGES\7.0\ABXM-CORE\1.5.4\ABxM.Core.dll", "C:\USERS\LASAT\APPDATA\ROAMING\GRASSHOPPER\LIBRARIES\ABxM.IAAC.Core.dll"])  # -> out, oBehavior; inputs iWeight: Double, iEnable: Boolean, iVector: Vector3d
# ---------- add_rotation_3: C# ----------
    behavior.Enable = iEnable;
    if(behavior.CustomData.ContainsKey("Trigger"))
      behavior.CustomData["Trigger"] = new GH_Boolean(false);
    else
      behavior.CustomData.Add("Trigger", new GH_Boolean(false));

    behavior.Vector = iVector;
    behavior.Weight = iWeight;
    oBehavior = behavior;
# ---------- add_rotation_3: C# additional code ----------
  AddMoveBehavior behavior = new AddMoveBehavior();

  public class AddMoveBehavior : BehaviorBase
  {

    public bool Enable;
    public Vector3d Vector;

    public override void Execute(AgentBase agent)
    {
      if (Enable)
      {
        PlaneAgent planeAgent = (PlaneAgent) agent;
        int step = (int) planeAgent.CustomData["PauseCount"];
        GH_Boolean trigger = (GH_Boolean) this.CustomData["Trigger"];

        if (trigger.Value)
        {
          if (step == 0 && (bool) planeAgent.CustomData["Pick"] == false && (bool) planeAgent.CustomData["Place"] == false )
          {
            Vector3d moveAway = Vector;
            planeAgent.Moves.Add(moveAway);
            planeAgent.Weights.Add(Weight);
          }
        }
      }
    }
  }
# ---------- end add_rotation_3 ----------
update_behaviour_3 = UpdateBehaviour(Behavior=add_rotation_3.oBehavior, Key="Trigger", Value=c_script_7.A)  # -> Status, Behavior

# ----
# Behavior - Stop Robot
enable = BooleanToggle(True)
add_rotation_4 = CSharpScript(
    iEnable=enable,
    Reference=["C:\USERS\LASAT\APPDATA\ROAMING\MCNEEL\RHINOCEROS\PACKAGES\7.0\ABXM-CORE\1.5.4\ABxM.Core.dll", "C:\USERS\LASAT\APPDATA\ROAMING\GRASSHOPPER\LIBRARIES\ABxM.IAAC.Core.dll"])  # -> out, oBehavior; inputs iEnable: Boolean
# ---------- add_rotation_4: C# ----------
    behavior.Enable = iEnable;
    if (!behavior.CustomData.ContainsKey("Stop"))
    {
      behavior.CustomData.Add("Stop", 2);
    }
    oBehavior = behavior;
# ---------- add_rotation_4: C# additional code ----------
  PauseBehavior behavior = new PauseBehavior();

  public class PauseBehavior : BehaviorBase
  {
    public GH_Integer State;
    public bool Enable = false;

    public PauseBehavior()
    {
      if (!this.CustomData.ContainsKey("Stop"))
      {
        this.CustomData["Stop"] = new GH_Integer(0);
      }
      State = (GH_Integer) this.CustomData["Stop"];
    }

    public override void Execute(AgentBase agent)
    {
      PlaneAgent planeAgent = (PlaneAgent) agent;

      if (Enable)
      {
        if (agent is PlaneAgent)
        {
          State = (GH_Integer) this.CustomData["Stop"];
          bool newState = planeAgent.Stop;

          if (State.Value == 0)
          {
            newState = true;
          }
          if (State.Value == 1)
          {
            newState = false;
          }
          planeAgent.Stop = newState;
        }
      }
      else
        planeAgent.Stop = false;
    }
  }
# ---------- end add_rotation_4 ----------
update_behaviour_4 = UpdateBehaviour(Behavior=add_rotation_4.oBehavior, Key="Stop", Value=c_script_6.A)  # -> Status, Behavior

# ---- group: Sensor
merge_2 = Merge(
    Data1=flatten(add_rotation_4.oBehavior),
    Data2=flatten(separation.oBehavior),
    Data3=flatten(add_rotation.oBehavior),
    Data4=flatten(add_rotation_3.oBehavior),
    Data5=flatten(add_rotation_2.oBehavior))

# ----
filter_6 = StreamFilter(Gate=c_script_2.oType)

# ----
# Table
swatch = ColourSwatch(SwatchColor=RGBA(255, 255, 255, 141))
preview = CustomPreview(Geometry=filter_6, Material=swatch)

# ---- group: Rob-2 / Open
mesh = Mesh(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)

# ----
mesh_2 = Mesh(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)

# ---- group: Rob 1 / Opeb
mesh_3 = Mesh(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)

# ----
xy = XYPlane(Origin=Point(0, 0, 0))
Z = UnitZ(Factor="157.5")
move = Move(Geometry=xy, Motion=Z)  # -> Geometry, Transform

pln = Plane(cluster.O)
crv = Curve(pline)
pln_2 = Plane(cluster.i)
cluster_2 = Cluster(L=crv)
cluster_3 = Cluster(L=pln_2)
cluster_4 = Cluster(L=pln)
filter_7 = StreamFilter(Gate=toggle, Stream0=pln_2, Stream1=cluster_3)
filter_8 = StreamFilter(Gate=toggle, Stream0=pln, Stream1=cluster_4)

cp = ControlPoints(Curve=cluster_2)  # -> simplify(Points), Weights, Knots
cullpt_2 = CullDuplicates(Points=cp.Points, Tolerance=0.1, CullMode=1)  # -> Points, Indices, Valence
pline_2 = PolyLine(Vertices=cullpt_2.Points, Closed=False)  # -> flatten(Polyline)

filter_9 = StreamFilter(Gate=toggle, Stream0=crv, Stream1=pline_2)

# ----
# Update Feedback
number_slider_11 = Slider(5, range=0..10)

# ----
# Half Planes and Drop Offset
toggle_2 = BooleanToggle(True)
num = Number(block_height)
crv_2 = Curve(filter_9)
pln_3 = Plane(filter_8)
pln_4 = Plane(filter_7)
cluster_5 = Cluster_3(L=crv_2, d1=num, G=Toggle(False))
cluster_6 = Cluster_3(L=pln_4, d1=num, G=Toggle(False))
cluster_7 = Cluster_3(L=pln_3, d1=num, G=toggle_2)
filter_10 = StreamFilter(Gate=half_mode, Stream0=pln_3, Stream1=cluster_7)
filter_11 = StreamFilter(Gate=half_mode, Stream0=crv_2, Stream1=cluster_5)
filter_12 = StreamFilter(Gate=half_mode, Stream0=pln_4, Stream1=cluster_6)
pl_offset = PlaneOffset(BasePlane=filter_12, Offset=drop_plane_offset)
pln_5 = Plane(pl_offset)
pln_6 = Plane(filter_10)

python = GhPythonScript(x=half_mode, y=filter_11)  # -> out, a; inputs y: list of Curve
# ---------- python: Python ----------
__author__ = "Sam Leder"
__version__ = "2024.05.30"

import rhinoscriptsyntax as rs
import Rhino.Geometry as rg



a = []
if x:
    for i in range(len(y)):
        b = y[i]
        if (i != 2 and i !=4 and i !=6 and i !=8):
            b = y[i].Extend(rg.CurveEnd.Start, 15, 0)
        a.append(b)
else:
    for i in range(len(y)):
        b = y[i]
        a.append(b)
# ---------- end python ----------

crv_3 = Curve(python.a)

# ----
# ABxM
# Environment
boundary_corners = Point([Point(0, 0, 0), Point(35, 1, 0), Point(45, 21, 0), Point(28, 38, 0), Point(4, 36, 0), Point(-16, 22, 0)])
pln_7 = Plane(pln_6)
crv_4 = Curve(crv_3)
pln_8 = Plane(pln_5)
c_script_8 = CSharpScript(
    iReset=reset_abxm,
    iBoundaryCorners=boundary_corners,
    iTimberStart=pln_7,
    iPaths=crv_4,
    iTimberPlace=pln_8,
    Reference="C:\USERS\LASAT\APPDATA\ROAMING\MCNEEL\RHINOCEROS\PACKAGES\7.0\ABXM-CORE\1.5.4\ABxM.Core.dll")  # -> out, oEnvironment; inputs iBoundaryCorners: list of Point3d, iTimberStart: list of Plane, iPaths: list of Polyline, iTimberPlace: list of Plane
# ---------- c_script_8: C# usings ----------
using System.IO;
using System.Linq;
using System.Data;
using System.Drawing;
using System.Reflection;
using System.Windows.Forms;
using System.Xml;
using System.Xml.Linq;
using System.Runtime.InteropServices;

using Rhino.DocObjects;
using Rhino.Collections;
using GH_IO;
using GH_IO.Serialization;
using ABxM.Core;
using ABxM.Core.Utilities;
using ABxM.Core.Environments;
using ABxM.Core.Behavior;
using ABxM.Core.Agent;
using ABxM.Core.AgentSystem;
# ---------- c_script_8: C# ----------
    CartesianEnvironment env = new CartesianEnvironment(iBoundaryCorners);
    env.CustomData.Add("Timber", iTimberStart);
    env.CustomData.Add("Paths", iPaths);
    env.CustomData.Add("TimberGoal", iTimberPlace);
    oEnvironment = env;
# ---------- c_script_8: C# additional code ----------
  /// <summary>
  /// This method will be called once every solution, before any calls to RunScript.
  /// </summary>
  public override void BeforeRunScript()
  { }
  /// <summary>
  /// This method will be called once every solution, after any calls to RunScript.
  /// </summary>
  public override void AfterRunScript()
  { }
# ---------- end c_script_8 ----------

# ----
# Agents
panel_12 = Panel("""Gripper
Pick
Place
Sensor
PauseCount
CurrentCurve
SensorIteration""")
xy_2 = XYPlane(Origin=safe_point)
c_script_9 = CSharpScript(
    K=panel_12,
    point=safe_point,
    Reference="C:\USERS\LASAT\APPDATA\ROAMING\MCNEEL\RHINOCEROS\PACKAGES\7.0\ABXM-CORE\1.5.4\ABxM.Core.dll")  # -> out, A; inputs K: list of String, point: Point3d
# ---------- c_script_9: C# usings ----------
using ABxM.Core.Agent;
# ---------- c_script_9: C# ----------
    List<Dictionary<string, object>> customData = new List<Dictionary<string, object>>();



    Dictionary<string, object> myData = new Dictionary<string, object>();

    for(int j = 0; j < K.Count; j++)
    {
      string myKey = K[j];
      if (j == 4 || j == 5 || j == 6)
      {
        myData.Add(myKey, 0);
      }
      else
      {
        myData.Add(myKey, false);
      }
    }

    customData.Add(myData);
    Print(myData.ToString());



    A = customData;
# ---------- c_script_9: C# additional code ----------
  /// <summary>
  /// This method will be called once every solution, before any calls to RunScript.
  /// </summary>
  public override void BeforeRunScript()
  { }
  /// <summary>
  /// This method will be called once every solution, after any calls to RunScript.
  /// </summary>
  public override void AfterRunScript()
  { }
# ---------- end c_script_9 ----------
flippln = FlipPlane(Plane=xy_2, FlipX=False, FlipY=False, FlipZ=True)  # -> Flipped, R

# ----
# Strut
xy_3 = XYPlane(Origin=Point(0, 0, 0))
mesh_4 = Mesh(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)
bbox = BoundingBox(Content=mesh_4, Plane=PlaneXY(0, 0, 0))  # -> Box, Box_2
flippln_2 = FlipPlane(Plane=xy_3, FlipX=False, FlipY=False, FlipZ=True)  # -> Flipped, R

# ----
# Follow TCP
toggle_3 = BooleanToggle(False)

# ----
# Robot Information
panel_13 = Panel("")
neg_4 = Negative(Value=Slider(75, range=0..1000))
Z_2 = UnitZ(Factor=neg_4)
preview_2 = CustomPreview(Geometry=brep, Material=ColourSwatch(SwatchColor=RGBA(255, 255, 255, 39)))

# ----
# Current Path
number_slider_12 = Slider(5, range=0..10)

# ---- group: Rob 1
mesh_5 = Mesh(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)

# ----
# ROBOT KINEMATICS
point = Point(Point(-3.536362293, -1.54850738, 0))
xy_plane = XYPlane(Origin=point)
merge_3 = Merge(Data1=Toggle(False), Data2=Toggle(False), Data3=Toggle(True))

# ----
# Get RobotData Continuously
number_slider_13 = Slider(10, range=0..1000)
panel_14 = Panel("""actual_q
actual_qd""")
# ROBOT COMMUNICATION RECIEVE
bool = Boolean(visulaize_real_robot)

or = GateOr(A=run_robot, B=bool)

ur_rtde_output = URRTDEOutput(Activate=or, IP=robot_ip_address, Outputs=panel_14, Frequency=number_slider_13)  # -> Log, Response
robot_feedback_data = Data(ur_rtde_output.Response)
panel_15 = Panel(robot_feedback_data)

branch = TreeBranch(Tree=robot_feedback_data, Path="{2}", MaintainPaths=True)
c_script_10 = CSharpScript(x=branch, y=number_slider_11)  # -> out, A; inputs x: list of Double, y: Int32
# ---------- c_script_10: C# usings ----------
using System.Linq;
# ---------- c_script_10: C# ----------
    if(Math.Round(x.Sum(), y) == 0) A = new List<double>{1000};
    else A = x;
# ---------- end c_script_10 ----------
ma = MassAddition(Input=c_script_10.A)  # -> Result, PartialResults
panel_16 = Panel(ma.Result)
roundd = RoundToDecimalPlace(NumberX=ma.Result, DecimalPlace=Slider(1, range=0..10), RoundType=0)  # -> Rounded, Difference
exprire = Exprire(Run=run_robot, Input=roundd.Rounded, Seconds=Slider(0.1, range=0..10))

# ----
# Behavior - Update
bool_2 = Boolean(exprire)
update = CSharpScript(iTrigger=bool_2, Reference="C:\USERS\LASAT\APPDATA\ROAMING\MCNEEL\RHINOCEROS\PACKAGES\7.0\ABXM-CORE\1.5.4\ABxM.Core.dll")  # -> out, oBehavior; inputs iTrigger: Int32; disabled
# ---------- update: C# usings ----------
using ABxM.Core;
using ABxM.Core.Agent;
using ABxM.Core.AgentSystem;
using ABxM.Core.Behavior;
using ABxM.Core.Environments;
# ---------- update: C# ----------
  oBehavior = behavior;
# ---------- update: C# additional code ----------
  
  UpdateBehavior behavior = new UpdateBehavior();

  public class UpdateBehavior : BehaviorBase
  {

    public override void Execute(AgentBase agent)
    {

    }
  }
# ---------- end update ----------

# ---- group: Core
merge_4 = Merge(
    Data1=flatten(curve.oBehavior),
    Data2=flatten(safety_behavior.oBehavior),
    Data3=flatten(tween.oBehavior),
    Data4=flatten(containment.oBehavior),
    Data5=flatten(pick_place_pause.oBehavior),
    Data6=flatten(update.oBehavior))

# ----
merge_5 = Merge(Data1=flatten(merge_4), Data2=flatten(merge_2))

plane_agent = DefinePlaneAgent(Positions=flippln.Flipped, Behaviors=merge_5, CustomData=c_script_9.A)

# ----
# Agent System
c_script_11 = CSharpScript(
    iEnv=c_script_8.oEnvironment,
    iAgents=plane_agent,
    Reference=["C:\USERS\LASAT\APPDATA\ROAMING\MCNEEL\RHINOCEROS\PACKAGES\7.0\ABXM-CORE\1.5.4\ABxM.Core.dll", "C:\USERS\LASAT\APPDATA\ROAMING\GRASSHOPPER\LIBRARIES\ABxM.IAAC.Core.dll"])  # -> out, oAS; inputs iAgents: list
# ---------- c_script_11: C# ----------
    List<PlaneAgent> agents = new List<PlaneAgent>();
    foreach (PlaneAgent agent in iAgents) agents.Add(agent);

    CustomAgentSystem AS = new CustomAgentSystem(agents, iEnv as CartesianEnvironment);
    oAS = AS;
# ---------- c_script_11: C# additional code ----------
  public class CustomAgentSystem : PlaneAgentSystem
  {

    // You can add new fields, properties, or methods specific to your child class here

    // Constructor for your child class
    public CustomAgentSystem(List<PlaneAgent> agents, CartesianEnvironment cartesianEnvironment)
      : base(agents, cartesianEnvironment)
    {
      // Optionally add initialization specific to your child class
    }

    public override void PostExecute()
    {
      for (int i = 0; i < this.Agents.Count; i++)
      {
        PlaneAgent agent = (PlaneAgent) this.Agents[i];
        agent.PostExecute();

        if (i == 0)
        {
          bool gripper = (bool) agent.CustomData["Gripper"];
          if (gripper)
          {
            int curveIndex = (int) agent.CustomData["CurrentCurve"];
            if (curveIndex <= ((List<Plane>) this.CartesianEnvironment.CustomData["Timber"]).Count)
            {
              Plane timberPlane = agent.Position;
              //timberPlane.Transform(Transform.Translation(timberPlane.Normal));
              ((List<Plane>) this.CartesianEnvironment.CustomData["Timber"])[curveIndex - 1] = timberPlane;
            }
          }
        }
      }
    }


  }
# ---------- end c_script_11 ----------

# ----
# Solver
solver = StepByStepSolver(Reset=reset_abxm, Execute=simulation_run_abxm, AgentSystems=c_script_11.oAS)  # -> DisplayGeometries, AllAgentSystems, IterationCount

# ----
# VISUALIZATION
visualize = CSharpScript(
    iAgentSystem=solver.AllAgentSystems,
    Reference=["C:\Users\Lasat\AppData\Roaming\McNeel\Rhinoceros\packages\7.0\ABxM-Core\1.5.4\ABxM.Core.dll", "C:\Users\Lasat\AppData\Roaming\Grasshopper\Libraries\ABxM.IAAC.Core.dll"])  # -> out, oAgentPositions, oAgentPlane, oPick, oPlace, oSensor, oGripper, oCurve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
# ---------- visualize: C# usings ----------
using System.Drawing;
using System.Windows.Markup;
using ABxM.Core.Agent;
using ABxM.Core.AgentSystem;
using ABxM.Core.Environments;

using ABxM.IAAC.Core.Agent;
using ABxM.IAAC.Core.AgentSystem;
# ---------- visualize: C# ----------
    agentSystem = (PlaneAgentSystem) iAgentSystem;
    CartesianEnvironment env = (CartesianEnvironment) agentSystem.CartesianEnvironment;

    List<Point3d> agentPositions = new List<Point3d>();
    List<Plane> agentPlane = new List<Plane>();
    List<bool> pick = new List<bool>();
    List<bool> place = new List<bool>();
    List<bool> sensor = new List<bool>();
    List<bool> grip = new List<bool>();
    List<int> curveCount = new List<int>();
    List<Plane> timber = (List<Plane>) env.CustomData["Timber"];
    List<int> pauseCount = new List<int>();
    List<bool> stop = new List<bool>();

    foreach (PlaneAgent agent in agentSystem.Agents)
    {
      agentPositions.Add(agent.Position.Origin);
      agentPlane.Add(agent.Position);
      pick.Add((bool) agent.CustomData["Pick"]);
      place.Add((bool) agent.CustomData["Place"]);
      sensor.Add((bool) agent.CustomData["Sensor"]);
      grip.Add((bool) agent.CustomData["Gripper"]);
      curveCount.Add((int) agent.CustomData["CurrentCurve"]);
      pauseCount.Add((int) agent.CustomData["PauseCount"]);
      stop.Add(agent.Stop);

    }

    oAgentPositions = agentPositions;
    oAgentPlane = agentPlane;
    oPick = pick;
    oPlace = place;
    oSensor = sensor;
    oGripper = grip;
    oCurve = curveCount;
    oTimber = timber;
    oPause = pauseCount;
    oStop = stop;
# ---------- visualize: C# additional code ----------
  private PlaneAgentSystem agentSystem;
# ---------- end visualize ----------

item = ListItem(List=crv_4, Index=visualize.oCurve, Wrap=True)
previewlw_2 = CustomPreviewLineweights(Geometry=item, Shader=ColourSwatch(SwatchColor=RGB(0, 200, 255)), Thickness=number_slider_12, Absolute=False)

orient = Orient(Geometry=bbox.Box, Source=flippln_2.Flipped, Target=visualize.oTimber)  # -> Geometry, Transform
preview_3 = CustomPreview(Geometry=orient.Geometry, Material=ColourSwatch(SwatchColor=RGBA(186, 185, 128, 162)))

pln_9 = Plane(visualize.oAgentPlane)

box = CenterBox(Base=pln_9, X=150, Y=150, Z=10)
zbb = ZoomBoundingBox(Box=box, Run=toggle_3)

pln_10 = Plane(visualize.oTimber)

# ----
# Behaviour Vectors
display_behavior_vectors = DisplayBehaviorVectors(
    AgentSystems=solver.AllAgentSystems,
    Behavior=merge_5,
    TextSize=6,
    ArrowLineThickness=2,
    RotationRadius=100,
    RotationRadiusOffset=20,
    seeRings=True)  # -> AgentPosition, BehaviorVectors, BehaviorRotations

concat = Concatenate(
    FragmentA="Pick: ",
    FragmentB=visualize.oPick,
    FragmentG=panel_13,
    FragmentC="Place: ",
    FragmentD=visualize.oPlace,
    FragmentH=panel_13,
    FragmentE="Sensor: ",
    FragmentF=visualize.oSensor,
    FragmentI=panel_13,
    FragmentJ="Gripper: ",
    FragmentK=visualize.oGripper,
    FragmentL=panel_13,
    FragmentM="Curve: ",
    FragmentN=visualize.oCurve,
    FragmentP=panel_13,
    FragmentO="Pause: ",
    FragmentQ=visualize.oPause,
    FragmentT=panel_13,
    FragmentR="Stop:",
    FragmentS=visualize.oStop)
move_2 = Move(Geometry=visualize.oAgentPositions, Motion=Z_2)  # -> Geometry, Transform
tag = TextTag(Location=move_2.Geometry, Text=concat, Colour=ColourSwatch(SwatchColor=RGB(0, 0, 0)))

# ---- group: Rob 1 (continued)
filter_13 = StreamFilter(Gate=visualize.oGripper, Stream0=mesh_3, Stream1=mesh_5)

# ---- group: Rob-2
filter_14 = StreamFilter(Gate=visualize.oGripper, Stream0=mesh, Stream1=mesh_2)

# ----
filter_15 = StreamFilter(Gate=c_script_2.oType, Stream0=filter_13, Stream1=filter_14)

pln_11 = Plane(visualize.oAgentPlane)
end_effector = DefineEndEffector(Geometry=filter_15, TCPFrame=move.Geometry, MountingFrame=xy)
ur10 = PredefinedUniversalRobotUR10(BaseFrame=xy_plane, EndEffectorOptional=end_effector)
robot_ik = RobotInverseKinematics(Robot=ur10, TargetTCPFrame=pln_11, AxisToggles=merge_3, useColorPreview=True)  # -> PoseGeometry, AxisValues, AxisFrames

# ----
# ROBOT COMMUNICATION SEND
# Robot Position
rad = Radians(Degrees=robot_ik.AxisValues)
panel_17 = Panel(rad)
bool_3 = Boolean(send_commands_to_robot)
ur_rtde_input = URRTDEInput(Activate=bool_3, IP=robot_ip_address, Values=rad)
panel_18 = Panel(ur_rtde_input)

# ----
# Visualize Robot
filter_16 = StreamFilter(Gate=visulaize_real_robot, Stream1=robot_feedback_data)
tree_branch = TreeBranch(Tree=filter_16, Path="{0}", MaintainPaths=True)
deg = Degrees(Radians=tree_branch)
robot_fk = RobotForwardKinematics(Robot=ur10, AxisValues=deg, useColorPreview=True)  # -> PoseGeometry, TCPFrame, AxisFrames
split = SplitList(List=robot_fk.PoseGeometry, Index=7)  # -> ListA, ListB
list_length = ListLength(List=split.ListA)
range = Range(Domain=Domain(0, 1), Steps=expr("x-1", list_length))
gradient_2 = Gradient(
    LowerLimit=0,
    UpperLimit=1,
    Parameter=range,
    stops=[0: RGB(243, 57, 0), 0.1: RGB(236, 27, 60), 0.2: RGB(210, 0, 118), 0.3: RGB(103, 0, 120), 0.4: RGB(39, 72, 161), 0.5: RGB(1, 192, 229), 0.6: RGB(18, 178, 90), 0.7: RGB(79, 186, 8), 0.8: RGB(220, 237, 32), 0.9: RGB(247, 159, 20), 1: RGB(243, 57, 0)])
custom_preview = CustomPreview(Geometry=split.ListB, Material=ColourSwatch(SwatchColor=RGBA(0, 0, 0, 175)))
custom_preview_2 = CustomPreview(Geometry=split.ListA, Material=gradient_2)

# ----
# Gripper Position
bool_4 = Boolean(visualize.oGripper)
panel_19 = Panel(bool_4)
bool_5 = Boolean(send_commands_to_robot)
panel_20 = Panel(bool_5)

# ---- group: Connect to (x)
python_2 = GhPythonScript(x=bool_4)  # -> out, a
# ---------- python_2: Python ----------
if x: 
    a = "SET GTO 0 \n SET POS 240\n SET GTO 1\n"
    
else: 
     a = "SET GTO 0 \n SET POS 50\n SET GTO 1\n"
# ---------- end python_2 ----------

# ----
panel_21 = Panel(python_2.a)
send = SendCommandToRobot(Run=bool_5, Command=python_2.a, IP=robot_ip_address, Port="63352")
panel_22 = Panel(send)

# ==== cluster Cluster
L = ClusterInput()
item = ListItem(List=L, Index=0, Wrap=True)
merge = Merge(Data1=flatten(item), Data2=flatten(L))
R = ClusterOutput(merge)

# ==== cluster Cluster_2

# ----
# Movement
linear_height = Slider(200, range=0..1000)
catenary_factor = Slider(1.2, range=0..3)

# ----
# Picking Locations
distance = Slider(120, range=0..1000)
number_of_piles = Slider(4, range=0..10)

# ----
# Curve
rebuild_curve = Slider(20, range=0..100)

# ----
# Pick Pt. Ref
number_slider = Slider(-803, range=-1000..200)
# Tool-Path Params
number_slider_2 = Slider(-664, range=-1000..200)
pt = ConstructPoint(XCoordinate=number_slider_2, YCoordinate=number_slider, ZCoordinate=Slider(315, range=-100..500))

# ----
# Tower Base Ref
number_slider_3 = Slider(315, range=-100..500)
# Tower Params
number_slider_4 = Slider(-774, range=-1000..200)
pt_2 = ConstructPoint(XCoordinate=number_slider_4, YCoordinate=Slider(-281, range=-500..500), ZCoordinate=number_slider_3)

# ----
# No. of Units
number_slider_5 = Slider(8, range=0..10)

# ----
# Unit Params
number_slider_6 = Slider(75, range=0..100)
height = Slider(15, range=0..100)

num = ClusterInput()
tower_base = ClusterInput()  # Tower Base
pick_pt = ClusterInput()  # Pick Pt.

pt_3 = Point(tower_base)
num_2 = Number(number_slider_6)
num_3 = Number(Slider(25, range=0..100))
num_4 = Number(num)
num_5 = Number(number_slider_5)
num_6 = Number(rebuild_curve)
num_7 = Number(Slider(90, range=0..100))
pt_4 = Point(pick_pt)
num_8 = Number(distance)
num_9 = Number(number_of_piles)
num_10 = Number(linear_height)
num_11 = Number(catenary_factor)

# ---- group: Base Unit (mm)
# GEOMETRY
rectangle = Rectangle(Plane=pt_3, XSize=num_2, YSize=num_3, Radius=0)  # -> Rectangle, Length

# ---- group: Tower Base
neg = Negative(Value=num_3)
Z = UnitZ(Factor=num_4)
Y = UnitY(Factor=[num_3, neg])
move = Move(Geometry=rectangle.Rectangle, Motion=Y)  # -> Geometry, Transform
extr = Extrude(Base=move.Geometry, Direction=Z)

# ----
# Geometry: picking locations
rectangle_2 = Rectangle(Plane=pt_4, XSize=num_2, YSize=num_3, Radius=0)  # -> Rectangle, Length
series = Series(Start=0, Step=num_8, Count=num_9)  # -> graft(Series)
Y_2 = UnitY(Factor=series)
move_2 = Move(Geometry=rectangle_2.Rectangle, Motion=Y_2)  # -> Geometry, Transform
series_2 = Series(Start=0, Step=num_4, Count=num_9)
Z_2 = UnitZ(Factor=num_4)
extr_2 = Extrude(Base=move_2.Geometry, Direction=Z_2)
Z_3 = UnitZ(Factor=series_2)
move_3 = Move(Geometry=extr_2, Motion=Z_3)  # -> Geometry, Transform

# ---- group: All bricks
cap = CapHoles(Brep=move_3.Geometry)

# ----
# 16-BRICK TOWER
panel = Panel(num_4)
panel_2 = Panel(num_9)
move_4 = Move(Geometry=move_2.Geometry, Motion=Z_3)  # -> Geometry, Transform

area = Area(Geometry=move_4.Geometry)  # -> Area, Centroid

# ----
# CRVs: pick
multiplication = Multiplication(A=panel, B=panel_2)
graft = GraftTree(Tree=move_2.Geometry, IncludeEmptyLists=True, IncludeNullItems=True)
Z_4 = UnitZ(Factor=multiplication)
move_5 = Move(Geometry=graft, Motion=Z_4)  # -> Geometry, Transform
area_2 = Area(Geometry=move_5.Geometry)  # -> Area, flatten(Centroid)
Z_5 = UnitZ(Factor=1)
panel_3 = Panel(num_10)
rev = ReverseList(List=area_2.Centroid)  # -> graft(List)
line = LineSDL(Start=rev, Direction=Z_5, Length=num_10)  # -> simplify(graft(Line))

# ----
# Geometry: tower
panel_4 = Panel(extr)
area_3 = Area(Geometry=rectangle.Rectangle)  # -> Area, Centroid
rotate = Rotate(Geometry=extr, Angle=degrees(num_7), Plane=area_3.Centroid)  # -> Geometry, Transform
group = Group(Objects=rotate.Geometry)
group_2 = Group(Objects=extr)
series_3 = Series(Start=0, Step=num_4, Count=num_5)
Z_6 = UnitZ(Factor=series_3)
panel_5 = Panel("""0
1""")
move_6 = Move(Geometry=group, Motion=Z_6)  # -> Geometry, Transform
move_7 = Move(Geometry=group_2, Motion=Z_6)  # -> flatten(Geometry), Transform
sift = SiftPattern(List=move_6.Geometry, SiftPattern=panel_5)  # -> Output0, Output1
sift_2 = SiftPattern(List=move_7.Geometry, SiftPattern=panel_5)  # -> Output0, Output1
clean = CleanTree(RemoveNulls=True, RemoveInvalid=True, RemoveEmpty=False, Tree=sift.Output1)
ungroup = Ungroup(Group=clean)  # -> simplify(Objects)
flip = FlipMatrix(Data=ungroup)  # -> flatten(Data)

# ---- group: rotate these planes
clean_2 = CleanTree(RemoveNulls=True, RemoveInvalid=True, RemoveEmpty=False, Tree=sift_2.Output0)

# ----
pl_origin = PlaneOrigin(Base=move_4.Geometry, Origin=area.Centroid)

ungroup_2 = Ungroup(Group=clean_2)  # -> simplify(Objects)
flip_2 = FlipMatrix(Data=ungroup_2)  # -> flatten(Data)

# ---- group: All tower bricks
cap_2 = CapHoles(Brep=[flip_2, flip])

# ----
geo = Geometry([cap_2, cap])

lng = ListLength(List=cap_2)
panel_6 = Panel(lng)

# ---- group: All Tower Bricks
debrep = DeconstructBrep(Brep=cap_2)  # -> Faces, Edges, Vertices

# ----
wires = BrepWireframe(Brep=cap_2, Density=-1)
W = ClusterOutput(wires)

# ----
# CRVs: place
panel_7 = Panel("{3}")
branch = TreeBranch(Tree=ungroup_2, Path=panel_7, MaintainPaths=True)
branch_2 = TreeBranch(Tree=ungroup, Path="{3}", MaintainPaths=True)
area_4 = Area(Geometry=[branch_2, branch])  # -> Area, simplify(graft(Centroid))
division = Division(A=num_4, B=2)
Z_7 = UnitZ(Factor=division)
move_8 = Move(Geometry=area_4.Centroid, Motion=Z_7)  # -> Geometry, Transform
rev_2 = ReverseList(List=move_8.Geometry)
Z_8 = UnitZ(Factor=1)
# TOOL-PATH
number_slider_7 = Slider(0, range=0..100)
series_4 = Series(Start=0, Step=Slider(30, range=0..100), Count=Slider(4, range=0..10))  # -> simplify(Series)

# ---- group: 1__pick: 16 CRVs
dup = DuplicateData(Data=line, Number=4, Order=True)  # -> simplify(Data)

# ----
len = Length(Curve=dup)
division_2 = Division(A=len, B=3)
divdist = DivideDistance(Curve=dup, Distance=division_2)  # -> Points, Tangents, Parameters
pline = PolyLine(Vertices=divdist.Points, Closed=False)

trim = TrimTree(Tree=pline, Depth=1)

# ---- group: 1__pick: 16 CRVs (continued)
crv = Curve(simplify(trim))

# ---- group: 4 CRVs
line_2 = LineSDL(Start=rev_2, Direction=Z_8, Length=num_10)

# ----
len_2 = Length(Curve=line_2)
division_3 = Division(A=len_2, B=3)
divdist_2 = DivideDistance(Curve=line_2, Distance=division_3)  # -> Points, Tangents, Parameters
pline_2 = PolyLine(Vertices=divdist_2.Points, Closed=False)  # -> simplify(Polyline)

# ---- group: 4 CRVs (continued)
crv_2 = Curve(simplify(pline_2))

# ----
ext = ExtendCurve(Curve=crv_2, Type=number_slider_7, Start=series_4, End=number_slider_7)  # -> simplify(Curve)

# ---- group: 3__place: 16 CRVs
flip_3 = FlipMatrix(Data=ext)

# ----
# CRVs: Catenary
end = EndPoints(Curve=crv)  # -> Start, End
end_2 = EndPoints(Curve=flip_3)  # -> Start, End
Z_9 = UnitZ(Factor=1)

dist = Distance(PointA=end_2.End, PointB=end.End)
multiplication_2 = Multiplication(A=dist, B=num_11)

cat = Catenary(PointA=end.End, PointB=end_2.End, Length=multiplication_2, Gravity=Z_9)

reb = RebuildCurve(Curve=cat, Count=num_6, Tangents=False)

# ----
# Full CRVs
merge = Merge(Data1=reverse(graft(crv)), Data2=reverse(graft(reb)), Data3=reverse(graft(flip_3)))
join = JoinCurves(Curves=merge, Preserve=False)  # -> simplify(Curves)
trim_2 = TrimTree(Tree=join, Depth=1)  # -> reverse(Tree)
flatten = FlattenTree(Tree=trim_2, Path="{0}")  # -> reverse(Tree)
number_slider_8 = Slider(0, range=0..100)
ext_2 = ExtendCurve(Curve=flatten, Type=number_slider_8, Start=number_slider_8, End=Slider(15, range=0..100))
number_slider_9 = Slider(0, range=0..100)
series_5 = Series(Start=Slider(15, range=0..100), Step=Slider(15, range=0..100), Count=Slider(4, range=0..10))
partition = PartitionList(List=ext_2, Size=Slider(4, range=0..10))

# ---- group: All CRVs
crv_3 = Curve(flatten)

# ----
# Plane Alignment
area_5 = Area(Geometry=debrep.Faces)  # -> Area, Centroid
pdecon = Deconstruct(Point=area_5.Centroid)  # -> XComponent, YComponent, ZComponent
sort = SortList(Keys=pdecon.ZComponent, ValuesA=debrep.Faces)  # -> Keys, ValuesA
item = ListItem(List=sort.ValuesA, Index=0, Wrap=True)
brec = BoundingRectangle(Geometry=item, Plane=PlaneXY(0, 0, 0), Axis=0, Slide=0, Union=True)  # -> Bounding, DimensionX, DimensionY
pln = Plane(flatten(brec.Bounding))
pdecon_2 = Deconstruct(Point=pln)  # -> XComponent, YComponent, ZComponent
points = PointList(Points=pln, Size=10)
sort_2 = SortList(Keys=pdecon_2.ZComponent, ValuesA=pln)  # -> Keys, ValuesA
dispatch = Dispatch(List=sort_2.ValuesA, DispatchPattern=[True, True, False, False])  # -> ListA, ListB
pframe = PerpFrame(Curve=reparameterize(flatten(crv_3)), Parameter=1)
rotate_2 = Rotate(Geometry=dispatch.ListA, Angle=degrees(90), Plane=dispatch.ListA)  # -> Geometry, Transform
weave = Weave(Pattern=[0, 0, 1, 1], Stream0=rotate_2.Geometry, Stream1=dispatch.ListB, NullGaps=False)
pln_2 = Plane(pl_origin)
cp = ClosestPoint(Point=pframe, Cloud=weave)  # -> ClosestPoint, CPIndex, Distance
rev_3 = ReverseList(List=flatten(pln_2))
rotate_3 = Rotate(Geometry=weave, Angle=degrees(Slider(90, range=-180..180)), Plane=weave)  # -> Geometry, Transform

panel_8 = Panel(area_5.Centroid)
panel_9 = Panel(sort.ValuesA)

# ---- group: All extended CRVs
ext_3 = ExtendCurve(Curve=partition, Type=number_slider_9, Start=series_5, End=number_slider_9)  # -> flatten(Curve)

# ----
C = ClusterOutput(ext_3)

# ---- group: Al placing planes
item_2 = ListItem(List=rotate_3.Geometry, Index=cp.CPIndex, Wrap=True)

# ---- group: all picking planes
flippln = FlipPlane(Plane=rev_3, FlipX=False, FlipY=False, FlipZ=True)  # -> Flipped, R
partition_2 = PartitionList(List=flippln.Flipped, Size=4)
group_3 = Group(Objects=partition_2)  # -> flatten(Group)
ungroup_3 = Ungroup(Group=reverse(group_3))  # -> flatten(Objects)

# ----
i = ClusterOutput(item_2)
O = ClusterOutput(ungroup_3)

# ==== cluster Cluster_3
L = ClusterInput()
d1 = ClusterInput()
merge = Merge(Data1=d1, Data2=Slider(0, range=0..100))
partition = PartitionList(List=L, Size=4)  # -> simplify(Chunks)
Z = UnitZ(Factor=merge)
Z_2 = UnitZ(Factor=d1)
G = ClusterInput()
cull = CullPattern(List=partition, CullPattern=[False, True])
neg = Negative(Value=Z)
item = ListItem(List=L, Index=Slider(0, range=0..1), Wrap=True)
neg_2 = Negative(Value=Z_2)
move = Move(Geometry=item, Motion=neg_2)  # -> flatten(Geometry), Transform
move_2 = Move(Geometry=cull, Motion=neg)  # -> flatten(Geometry), Transform
filter = StreamFilter(Gate=G, Stream0=item, Stream1=move.Geometry)
filter_2 = StreamFilter(Gate=G, Stream0=flatten(cull), Stream1=move_2.Geometry)
merge_2 = Merge(Data1=filter, Data2=filter_2)
R = ClusterOutput(merge_2)
