# Grasshopper definition custom_rock-paper-scissors.gh (Grasshopper 1.0.7)
# plug-ins: ABxM.Grasshopper, Heteroptera

number_slider = Slider(30, range=0..100)
define_containment_behavior = DefineContainmentBehavior(ContainmentDistance=Slider(0.5, range=0..1), Weight=Slider(0.5, range=0..1), Power=1)
define_boid_separation_behavior = DefineBoidSeparationBehavior(SeparationDistance=Slider(0.5, range=0..1), Weight=Slider(0.5, range=0..1), Power=1, AffectSelf=True)
define_boid_alignment_behavior = DefineBoidAlignmentBehavior(AlignmentDistance=Slider(0.5, range=0..1), Weight=Slider(0.5, range=0..1))
populate_2d = Populate2D(Region={Plane=PlaneXY(0, 0, 0), Size=Domain2(u=0..20, v=0..10)}, Count=number_slider, Seed=1)
random = Random(Range=Domain(0, 2), Number=populate_2d, Seed=2, Integers=True)  # -> flatten(Random)
ghpython_script = GhPythonScript(D=Slider(2.4, range=0..10))  # -> out, a
# ---------- ghpython_script: Python ----------
import clr
clr.AddReference("ABxM.Core.dll")
import ABxM.Core as abm

class RPSBehave(abm.Behavior.BehaviorBase):
    def __init__(self):
        self.Distance = 1
    
    def Execute(self,agent):
        boid = agent
        value = boid.CustomData["Type"]
        
        neighbors = boid.AgentSystem.FindNeighbors(boid, self.Distance)
        
        if len(neighbors) == 0:
            return
        
        closest_i = 0
        closest_distance = boid.Position.DistanceTo(neighbors[0].Position)
        
        for i in range(1, len(neighbors)):
            current_distance = boid.Position.DistanceTo(neighbors[i].Position)
            if current_distance < closest_distance:
                closest_i = i
                closest_distance = current_distance
        
        new_type = value
        if value == "R" and neighbors[closest_i].CustomData["Type"] == "P":
            new_type = "P"
        elif value == "P" and neighbors[closest_i].CustomData["Type"] == "S":
            new_type = "S"
        elif value == "S" and neighbors[closest_i].CustomData["Type"] == "R":
            new_type = "R"
        
        boid.NewCustomData["Type"] = new_type

behavior = RPSBehave()
behavior.Distance = D
a = behavior
# ---------- end ghpython_script ----------
merge = Merge(
    Data1=define_boid_alignment_behavior,
    Data2=define_boid_separation_behavior,
    Data3=define_containment_behavior,
    Data4=ghpython_script.a)
random_2 = Random(Range=Domain(0, 1), Number=number_slider, Seed=2)
random_3 = Random(Range=Domain(0, 1), Number=number_slider, Seed=2)
panel = Panel(random)
ghpython_script_2 = GhPythonScript(x=random)  # -> out, a; inputs x: list of Int32
# ---------- ghpython_script_2: Python ----------
from System.Collections.Generic import Dictionary
from System import String, Object

dict = []

for number in x:
    data = Dictionary[String, Object]()
    
    if number == 0:
        value = "R"
    elif number == 1:
        value = "P"
    else:
        value = "S"
    
    data["Type"] = value
    dict.append(data)
    
a = dict
# ---------- end ghpython_script_2 ----------
c_script = CSharpScript(x=random)  # -> out, A; inputs x: list of Int32
# ---------- c_script: C# ----------
    List<Dictionary< string, object>> customData = new List<Dictionary< string, object>> ();
    foreach (int number in x)
    {
      Dictionary<string,object> data = new Dictionary<string,object> ();
      string type;
      if (number == 0)
        type = "R";
      else if (number == 1)
        type = "P";
      else
        type = "S";

      data.Add("Type", type);
      customData.Add(data);

    }

    A = customData;
# ---------- end c_script ----------
vector_xyz = VectorXYZ(XComponent=random_2, YComponent=random_3, ZComponent=0)  # -> Vector, Length
define_boid = DefineBoid(Positions=populate_2d, Velocities=vector_xyz.Vector, Behaviors=ghpython_script.a, CustomData=ghpython_script_2.a)
number_slider_2 = Slider(24, range=0..100)
rectangle = Rectangle(Plane=PlaneXY(0, 0, 0), XSize=number_slider_2, YSize=number_slider_2, Radius=0)  # -> Rectangle, Length
define_single_brep_environment = DefineSingleBrepEnvironment(Brep=rectangle.Rectangle)  # -> BrepEnvironment, SurfaceCurvatures
define_boid_system = DefineBoidSystem(
    SurfaceEnvironment=define_single_brep_environment.BrepEnvironment,
    BoidAgents=define_boid,
    DisplacementThreshold=Slider(0, range=0..100),
    Timestep=0.02,
    MaxForce=3,
    MaxSpeed=2)
step_by_step_solver = StepByStepSolver(Reset=Button(), Execute=Toggle(False), AgentSystems=define_boid_system)  # -> DisplayGeometries, AllAgentSystems, IterationCount
dispatch = Dispatch(List=step_by_step_solver.DisplayGeometries, DispatchPattern=[True, False])  # -> ListA, ListB
ghpython_script_3 = GhPythonScript(x=step_by_step_solver.AllAgentSystems)  # -> out, a
# ---------- ghpython_script_3: Python ----------
types = []

for i in range (len(x.Agents)):
    boid = x.Agents[i]
    value = boid.CustomData["Type"]
    types.append(value)

a = types
# ---------- end ghpython_script_3 ----------
panel_2 = Panel(ghpython_script_3.a)
create_set = CreateSet(List=ghpython_script_3.a)  # -> Set, Map
vector_display = VectorDisplay(Anchor=dispatch.ListA, Vector=dispatch.ListB)
dispatch_unweave = DispatchUnweave(Data=dispatch.ListA, Pattern=create_set.Map)  # -> Out00, Out01, Out02
number_slider_3 = Slider(0.5, range=0..1)
polygon = Polygon(Plane=dispatch_unweave.Out02, Radius=number_slider_3, Segments=Slider(4, range=0..10), FilletRadius=0)  # -> Polygon, Length
polygon_2 = Polygon(Plane=dispatch_unweave.Out00, Radius=number_slider_3, Segments=Slider(5, range=0..10), FilletRadius=0)  # -> Polygon, Length
polygon_3 = Polygon(Plane=dispatch_unweave.Out01, Radius=number_slider_3, Segments=Slider(3, range=0..10), FilletRadius=0)  # -> Polygon, Length
custom_preview = CustomPreview(Geometry=polygon_3.Polygon, Material=ColourSwatch(SwatchColor=RGB(0, 64, 255)))
custom_preview_2 = CustomPreview(Geometry=polygon_2.Polygon, Material=ColourSwatch(SwatchColor=RGB(255, 255, 255)))
