# Grasshopper definition custom_seek.gh (Grasshopper 1.0.7)
# plug-ins: ABxM.Grasshopper

# ----
# © 2024 by ICD University of Stuttgart
# Behaviors
number_slider = Slider(50, range=0..100)
construct_point = ConstructPoint(XCoordinate=number_slider, YCoordinate=number_slider, ZCoordinate=0)
point = Point(construct_point)
define_boid_separation_behavior = DefineBoidSeparationBehavior(SeparationDistance=Slider(5, range=0..10), Weight=1, Power=1, AffectSelf=True)
define_boid_alignment_behavior = DefineBoidAlignmentBehavior(AlignmentDistance=Slider(5, range=0..10), Weight=1)
define_boid_cohesion_behavior = DefineBoidCohesionBehavior(CohesionDistance=Slider(5, range=0..10), Weight=1)
ghpython_script = GhPythonScript(iWeight=Slider(1, range=0..1), iTarget=point, iSlow_Down=Slider(10, range=0..10))  # -> out, oBehaviour; inputs iTarget: Point3d; disabled
# ---------- ghpython_script: Python ----------
import Rhino.Geometry as rg
import clr
clr.AddReference("ABxM.Core.dll")
import ABxM.Core as abm

class SeekBehaviour(abm.Behavior.BehaviorBase):
    def __init__(self, weight,target,slow_down):
        self.Weight = weight
        self.Target = target
        self.SlowDownRadius = slow_down
        
    def Execute(self, agent):
        boid = agent
        desired_velocity = (self.Target - boid.Position)
        desired_velocity.Unitize()
        desired_velocity *= boid.AgentSystem.MaxSpeed
        
        distance = self.Target.DistanceTo(boid.Position)
        
        if distance < self.SlowDownRadius:
            desired_velocity *= distance/self.SlowDownRadius
        
        steering = desired_velocity - boid.Velocity
        boid.AddForce(steering * self.Weight)

behaviour = SeekBehaviour(iWeight, iTarget, iSlow_Down)
oBehaviour = behaviour
# ---------- end ghpython_script ----------

number_slider_2 = Slider(56, range=0..100)
rectangle = Rectangle(Plane=PlaneXY(0, 0, 0), XSize=number_slider_2, YSize=number_slider_2, Radius=0)  # -> Rectangle, Length
c_script = CSharpScript(
    iRectangle=rectangle.Rectangle,
    iDistance=Slider(40, range=0..100),
    iWeight=Slider(1, range=0..1),
    Reference="C:\Users\ainho\AppData\Roaming\McNeel\Rhinoceros\packages\7.0\ABxM-Core\1.5.4\ABxM.Core.dll")  # -> out, oBehaviour; inputs iRectangle: Rectangle3d, iDistance: Double, iWeight: Double
# ---------- c_script: C# usings ----------
using ABxM.Core.Agent;
using ABxM.Core.AgentSystem;
using ABxM.Core.Behavior;
# ---------- c_script: C# ----------
    behaviour.Weight = iWeight;
    behaviour.Rectangle = iRectangle;
    behaviour.Distance = iDistance;
    oBehaviour = behaviour;
# ---------- c_script: C# additional code ----------
  public RectangleContainmentBehaviour behaviour = new RectangleContainmentBehaviour(1.0);

  public class RectangleContainmentBehaviour : BehaviorBase
  {
    public Rectangle3d Rectangle = Rectangle3d.Unset;
    public double Distance = 0;

    public RectangleContainmentBehaviour(double weight)
    {
      Weight = weight;
    }

    public override void Execute(AgentBase agent)
    {
      Boid boid = agent as Boid;
      Point3d newPosition = boid.Position + boid.Velocity;
      Vector3d desired = boid.Velocity;
      Vector3d steering = Vector3d.Unset;

      if (Rectangle.IsValid)
      {
        if(Rectangle.Contains(newPosition) == PointContainment.Outside)
        {
          Point3d projPt = Rectangle.ClosestPoint(newPosition);
          Vector3d transVt = projPt - newPosition;
          transVt.Unitize();
          Point3d target = Distance * transVt + projPt;
          desired = target - boid.Position;
          steering = desired - boid.Velocity;
          boid.AddForce(steering * Weight);
        }
      }

    }
  }
# ---------- end c_script ----------
merge = Merge(
    Data1=ghpython_script.oBehaviour,
    Data2=define_boid_separation_behavior,
    Data3=define_boid_cohesion_behavior,
    Data4=define_boid_alignment_behavior,
    Data5=c_script.oBehaviour)  # -> flatten(Result)

# ----
# Agent
number_slider_3 = Slider(95, range=0..100)
populate_3d = Populate3D(Region=rectangle.Rectangle, Count=number_slider_3, Seed=1)
boid = DefineBoid(Positions=populate_3d, Behaviors=merge)

merge_2 = Merge(Data1=boid)

# ----
# Agent System
number_slider_4 = Slider(0, range=0..0.0001)
number_slider_5 = Slider(0.1, range=0..0.1)
boid_sys = DefineBoidSystem(
    BoidAgents=merge_2,
    DisplacementThreshold=number_slider_4,
    Timestep=Slider(0.2, range=0..1),
    MaxForce=3,
    MaxSpeed=Slider(3, range=0..10))

# ----
# Solver
toggle = BooleanToggle(False)
solver = StepByStepSolver(Reset=Button(), Execute=toggle, AgentSystems=boid_sys)  # -> DisplayGeometries, AllAgentSystems, IterationCount

# ----
# Visualisation
dispatch = Dispatch(List=solver.DisplayGeometries, DispatchPattern=[True, False])  # -> ListA, ListB
cir = Circle(Plane=dispatch.ListA, Radius=1)
multiplication = Multiplication(A=dispatch.ListB, B=Slider(2, range=2..30))
srf = Surface(cir)
preview = CustomPreview(Geometry=srf, Material=ColourSwatch(SwatchColor=RGB(115, 159, 255)))
vdisex = VectorDisplayEx(Point=dispatch.ListA, Vector=multiplication, Colour=RGB(0, 0, 0), Width=2)
