# Grasshopper definition custom_u10e_control_simple.gh (Grasshopper 1.0.7)
# plug-ins: ABxM.IAAC

mqtt_publish = MQTTPublish(Activate=Toggle(False), Host="mqtt-dashboard.com", Port="1883", Msg="hello henry", Topic="/speech")
mqtt_subscribe = MQTTSubscribe(Activate=Toggle(True), Host="mqtt-dashboard.com", Port="1883", Topic="IAACWorkshop/Gestures/Test")  # -> Status, Topics, Messages
merge = Merge(
    Data1=Slider(52.13, range=-90..90),
    Data2=Slider(21.38, range=-90..90),
    Data3=Slider(-60.42, range=-90..90),
    Data4=Slider(-23.91, range=-90..90),
    Data5=Slider(-6.76, range=-90..90),
    Data6=Slider(-47.16, range=-90..90))
radians = Radians(Degrees=merge)
ur_rtde_input = URRTDEInput(Activate=Toggle(True), IP="192.168.56.101", Values=radians)
panel = Panel(ur_rtde_input)
panel_2 = Panel(mqtt_subscribe.Topics)
panel_3 = Panel(mqtt_subscribe.Messages)
panel_4 = Panel(mqtt_subscribe.Status)
mqtt_publish_2 = MQTTPublish(Activate=Toggle(False), Host="mqtt-dashboard.com", Port="1883", Msg="True", Topic="/speak")
mqtt_publish_3 = MQTTPublish(Activate=Toggle(False), Host="mqtt-dashboard.com", Port="1883", Msg="START", Topic="/robot_control")
mqtt_publish_4 = MQTTPublish(Activate=Toggle(True), Host="mqtt-dashboard.com", Port="1883", Msg="0", Topic="/brick")
mqtt_publish_5 = MQTTPublish(Activate=Toggle(False), Host="mqtt-dashboard.com", Port="1883", Msg="True", Topic="/speak_pos")
